# Grasshopper definition MT01 - Combine Stress Test.gh (Grasshopper 1.0.8)
# plug-ins: HAL for Grasshopper

sessionsettings = SessionSettings()  # -> Data, DefaultSettings

# ---- group: Cell Setup
cone = Cone(Base=PlaneXY(0, 0, 0), Radius=Slider(20, range=0..100), Length=Slider(200, range=0..1000))  # -> Cone, Tip
mesh = MeshBrep(
    Brep=cone.Cone,
    Settings={GridMaxCount=0, GridMinCount=16, JaggedSeams=False, MaxEdgeLength=0, MinEdgeLength=0.0001, MinTolerance=0, Refine=True, RefineAngle=0, RelativeTolerance=0.65, SimplePlanes=True, Tolerance=0})
xy = XYPlane(Origin=cone.Tip)
xy_2 = XYPlane(Origin=Point(0, 0, 0))
panel = Panel("Cone")
tool = Tool(
    Alias=panel,
    Frame=xy_2,
    Object_Body=mesh,
    ToolFrame=xy,
    _0_0=panel,
    _1_0=xy_2,
    _2_0=mesh,
    _6_0=xy,
    Mode=0,
    RunInBackground=False,
    nickName="Tool")
robot = Robot(
    Alias="Robot",
    Mode=0,
    RunInBackground=False,
    catalogItem="Mechanism,eef11b27-6f7d-47af-9d81-696fe3dab7b5",
    nickName="⧉ Robot")
attach = OBSOLETEAttach(
    Alias="Composite Mechanism",
    Parent=robot,
    Child=tool,
    IsEndEffector=True,
    Location=Plane(origin=(-1.234321012e+308, -1.234321012e+308, -1.234321012e+308), x=(0, 0, 0), y=(0, 0, 0)),
    InWorld=True,
    _1_0=robot,
    _2_0=tool,
    Mode=0,
    RunInBackground=False,
    nickName="Attach")
compositemechanism = CompositeMechanism(attach, isNickNameImplied=True)

# ---- group: Reference Setup
panel_2 = Panel("550")
panel_3 = Panel("10")
panel_4 = Panel("20")
panel_5 = Panel("1")
panel_6 = Panel("0")
panel_7 = Panel("0")
panel_8 = Panel("0")
quaternionframe = QuaternionFrame(
    XMm=panel_2,
    YMm=panel_3,
    ZMm=panel_4,
    Qw=panel_5,
    Qx=panel_6,
    Qy=panel_7,
    Qz=panel_8,
    _0_0=panel_2,
    _1_0=panel_3,
    _2_0=panel_4,
    _3_0=panel_5,
    _4_0=panel_6,
    _5_0=panel_7,
    _6_0=panel_8,
    Mode=0,
    RunInBackground=False,
    nickName="QuaternionFrame")
rotate = Rotate(Geometry=quaternionframe, Angle=degrees(Slider(0, range=-180..80)), Plane=quaternionframe)  # -> Geometry, Transform
panel_9 = Panel("Table")
reference = CreateReference(Alias=panel_9, Frame=rotate.Geometry, _0_0=panel_9, _1_0=rotate, Mode=0, RunInBackground=False, nickName="Reference")
table = Table(reference, isNickNameImplied=True)

# ---- group: Signal Setup
panel_10 = Panel("DO_01")
doutput = DigitalOutput(
    Alias=panel_10,
    LowV=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,
    HighV=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,
    Default=False,
    _0_0=panel_10,
    Mode=0,
    RunInBackground=False,
    nickName="DOutput")

do01 = DO_01(doutput, isNickNameImplied=True)

# ---- group: Monkey: Slow Speed + Large Blend Settings
speed = SpeedSettings(
    PositionMmS=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,
    OrientationRadS=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,
    Mode=0,
    RunInBackground=False,
    nickName="Speed")
blend = BlendSettings(
    PositionMm=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,
    OrientationRad=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,
    Mode=0,
    RunInBackground=False,
    nickName="Blend")
motionsettings = MotionSettings(
    Space={halEnum=0, halEnumType="HAL.Motion.Settings.MotionSpace"},
    Speed=speed,
    Blend=blend,
    _2_0=speed,
    _4_0=blend,
    Mode=0,
    RunInBackground=False,
    nickName="MotionSettings")

# ---- group: Program Robot / FollowCurveOrientedTowardsRobot
number_slider = Slider(5, range=0..100)
crv = Curve(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)
target = Target(
    Alias="Curve",
    Curve=crv,
    Discretization={halEnum=0, halEnumType="HAL.McNeel.RhinoCommon5.Spatial.CurveDiscretization"},
    ToleranceMm=number_slider,
    InWorld=True,
    _1_0=crv,
    _3_0=number_slider,
    Mode=0,
    RunInBackground=False,
    nickName="Target")  # -> Object_Target, Trace
target_2 = TargetProperties(Target=target.Object_Target, _0_0=target, Mode=0, RunInBackground=False, nickName="Target")  # -> Alias, Object_Joint, WayFrame, EndFrame, Reference, IsArc
xy_3 = XYPlane(Origin=Point(0, 0, 0))
vec2pt = Vector2Pt(PointA=xy_3, PointB=target_2.EndFrame, Unitize=False)  # -> Vector, Length
parallel = Parallel(
    Target=target.Object_Target,
    Direction=vec2pt.Vector,
    Axis={halEnum=0, halEnumType="HAL.Spatial.Axis"},
    Flip=True,
    Project=False,
    _0_0=target,
    _2_0=vec2pt,
    Mode=0,
    RunInBackground=False,
    nickName="Parallel")
panel_11 = Panel("FollowCurve")
move = Move(Alias=panel_11, Object_Target=parallel, _0_0=panel_11, _1_0=parallel, Mode=0, RunInBackground=False, nickName="Move")

# ---- group: Monkey: Jump from EndTargets
endtargets = GetEndTargets(Procedure=move, _0_0=move, Mode=0, RunInBackground=False, nickName="EndTargets")  # -> First, Last

# ---- group: Monkey: Extra Wait Action
wait = WaitTime(Alias="Wait", DurationS=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, Mode=0, RunInBackground=False, nickName="Wait")

# ---- group: Program Robot / JointMove
compositemechanism_2 = CompositeMechanism(compositemechanism, isNickNameImplied=True)
merge = Merge(
    Data1=Slider(-20, range=-180..180),
    Data2=Slider(28, range=-180..180),
    Data3=Slider(4, range=-180..180),
    Data4=Slider(0, range=-180..180),
    Data5=Slider(62, range=-180..180),
    Data6=Slider(0, range=-180..180))  # -> flatten(Result)
rad = Radians(Degrees=merge)
space = Space({halEnum=1, halEnumType="HAL.Motion.Settings.MotionSpace"}, EnumerationType="MotionSpace", isNickNameImplied=True)
target_3 = Target(
    Mechanism=compositemechanism_2,
    Object_Position=rad,
    _1_0=compositemechanism_2,
    _2_0=rad,
    Mode=0,
    RunInBackground=False,
    nickName="Target")
motionsettings_2 = OBSOLETEMotionSettings(Space=space, _1_0=space, Mode=0, RunInBackground=False, nickName="MotionSettings")
panel_12 = Panel("Initialize")
move_2 = Move(
    Alias=panel_12,
    Object_Target=target_3,
    Object_MotionSettings=motionsettings_2,
    _0_0=panel_12,
    _1_0=target_3,
    _2_0=motionsettings_2,
    Mode=0,
    RunInBackground=False,
    nickName="Move")

# ---- group: Program Robot / FollowCurveOnReference
number_slider_2 = Slider(360, range=0..1000)
number_slider_3 = Slider(10, range=0..10)
number_slider_4 = Slider(5, range=0..100)
cir = Circle(Plane=PlaneXY(0, 0, 0), Radius=Slider(100, range=0..1000))
speed_2 = SpeedSettings(Alias="Speeds", PositionMmS=number_slider_2, _1_0=number_slider_2, Mode=0, RunInBackground=False, nickName="Speed")
blend_2 = BlendSettings(Alias="SomeBlend", PositionMm=number_slider_3, _1_0=number_slider_3, Mode=0, RunInBackground=False, nickName="Blend")
table_2 = Table(table, isNickNameImplied=True)
crv_2 = Curve(cir)
target_4 = Target(
    Alias="Curve",
    Curve=crv_2,
    Discretization={halEnum=1, halEnumType="HAL.McNeel.RhinoCommon5.Spatial.CurveDiscretization"},
    ToleranceMm=number_slider_4,
    Reference=table_2,
    InWorld=False,
    _1_0=crv_2,
    _3_0=number_slider_4,
    _4_0=table_2,
    Mode=0,
    RunInBackground=False,
    nickName="Target")  # -> Object_Target, Trace
motionsettings_3 = OBSOLETEMotionSettings(
    Space={halEnum=0, halEnumType="HAL.Motion.Settings.MotionSpace"},
    Speed=speed_2,
    Blend=blend_2,
    _2_0=speed_2,
    _4_0=blend_2,
    Mode=0,
    RunInBackground=False,
    nickName="MotionSettings")
panel_13 = Panel("DoCircle")
move_3 = Move(
    Alias=panel_13,
    Object_Target=target_4.Object_Target,
    Object_MotionSettings=motionsettings_3,
    _0_0=panel_13,
    _1_0=target_4,
    _2_0=motionsettings_3,
    Mode=0,
    RunInBackground=False,
    nickName="Move")

# ---- group: Program Robot / JointMove
compositemechanism_3 = CompositeMechanism(compositemechanism, isNickNameImplied=True)
merge_2 = Merge(
    Data1=Slider(15, range=-180..180),
    Data2=Slider(-1, range=-180..180),
    Data3=Slider(10, range=-180..180),
    Data4=Slider(11, range=-180..180),
    Data5=Slider(46, range=-180..180),
    Data6=Slider(0, range=-180..180))  # -> flatten(Result)
rad_2 = Radians(Degrees=merge_2)
target_5 = Target(
    Mechanism=compositemechanism_3,
    Object_Position=rad_2,
    _1_0=compositemechanism_3,
    _2_0=rad_2,
    Mode=0,
    RunInBackground=False,
    nickName="Target")
motionsettings_4 = OBSOLETEMotionSettings(
    Space={halEnum=1, halEnumType="HAL.Motion.Settings.MotionSpace"},
    Mode=0,
    RunInBackground=False,
    nickName="MotionSettings")
panel_14 = Panel("Reset")
move_4 = Move(
    Alias=panel_14,
    Object_Target=target_5,
    Object_MotionSettings=motionsettings_4,
    _0_0=panel_14,
    _1_0=target_5,
    _2_0=motionsettings_4,
    Mode=0,
    RunInBackground=False,
    nickName="Move")

# ---- group: Program Robot / Wait Time
number_slider_5 = Slider(0.5, range=0..1)
wait_2 = WaitTime(Alias="Wait", DurationS=number_slider_5, _1_0=number_slider_5, Mode=0, RunInBackground=False, nickName="Wait")

# ---- group: Program Robot / Reset Signal
toggle = BooleanToggle(False)
do01_2 = DO_01(do01, isNickNameImplied=True)
signal = SetDigitalOutputSignal(
    Signal=do01_2,
    Effect={halEnum=1, halEnumType="HAL.Procedures.Actions.SignalEffect"},
    State=toggle,
    _1_0=do01_2,
    _3_0=toggle,
    Mode=0,
    RunInBackground=False,
    nickName="Signal")

# ---- group: Program Robot / Set Signal
toggle_2 = BooleanToggle(True)
do01_3 = DO_01(do01, isNickNameImplied=True)
signal_2 = SetDigitalOutputSignal(
    Signal=do01_3,
    Effect={halEnum=1, halEnumType="HAL.Procedures.Actions.SignalEffect"},
    State=toggle_2,
    _1_0=do01_3,
    _3_0=toggle_2,
    Mode=0,
    RunInBackground=False,
    nickName="Signal")

# ---- group: Program Robot / Combine into Sub-Procedure
merge_3 = Merge(Data1=flatten(signal_2), Data2=flatten(wait_2), Data3=flatten(signal))
panel_15 = Panel("ActivateEndEffector")
combine = CombineActions(
    Alias=panel_15,
    Object_Combined=[merge_3, wait],
    Compact=True,
    _0_0=panel_15,
    _1_0=merge_3,
    _1_1=wait,
    Mode=0,
    RunInBackground=False,
    nickName="Combine")

# ---- group: Monkey: Nested Combine (non-compact)
combine_2 = CombineActions(Object_Combined=[combine, <missing>], Compact=False, _1_0=combine, Mode=0, RunInBackground=False, nickName="Combine")

# ---- group: Merge and Combine
merge_4 = Merge(Data1=flatten(move_2), Data2=flatten(move), Data3=flatten(combine), Data4=flatten(move_3), Data5=flatten(move_4))
combine_3 = CombineActions(Object_Combined=merge_4, Compact=invert(True), _1_0=merge_4, Mode=0, RunInBackground=False, nickName="Combine")

# ---- group: Solve and Execute
compositemechanism_4 = CompositeMechanism(compositemechanism, isNickNameImplied=True)
do01_4 = DO_01(do01, isNickNameImplied=True)
panel_16 = Panel("Controller")
controller = Controller(
    Alias=panel_16,
    Object_Mechanism=compositemechanism_4,
    Object_Procedure=combine_3,
    Object_Signal=do01_4,
    _0_0=panel_16,
    _2_0=compositemechanism_4,
    _3_0=combine_3,
    _4_0=do01_4,
    Mode=0,
    RunInBackground=False,
    catalogItem="Controller,3169879c-d516-4db0-9e63-03018ff58094",
    nickName="⧉ Controller")
solve = OBSOLETEProcedureSolver(Controller=controller, Solve=Toggle(False), Mode=0, RunInBackground=True)  # -> Solution, Object_Solved, Notification

execution_control = ExecutionControl(Loop=False, TimeRatio=1)
execute = OBSOLETEExecute(
    ExecutionControl=execution_control,
    Solution=solve.Solution,
    displayEnvironment=True,
    displayMechanisms=True,
    displayTrace=True)
