# Grasshopper definition MT02 - Target Variations.gh (Grasshopper 1.0.8)
# plug-ins: HAL for Grasshopper

sessionsettings = SessionSettings()  # -> Data, DefaultSettings

# ---- group: Cartesian Targets / Target Point
pt = Point(Point(504.418436, -39.32957744, 379.2918869))

# ---- group: Joint Target / Robot for Target
robot = Robot(
    Alias="Robot",
    Mode=0,
    RunInBackground=False,
    catalogItem="Mechanism,1ee2801b-9834-4b40-a6d4-d961b1583ad5",
    nickName="⧉ Robot")

# ---- group: Joint Target / Joint Values
merge = Merge(
    Data1=Slider(0, range=-3.142..3.142),
    Data2=Slider(0, range=-3.142..3.142),
    Data3=Slider(0, range=-3.142..3.142),
    Data4=Slider(0, range=-3.142..3.142),
    Data5=Slider(0, range=-3.142..3.142),
    Data6=Slider(0, range=-3.142..3.142))

# ---- group: Targets from Curve / Curve to Follow
crv = Curve(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)

# ---- group: Targets from Curve
number_slider = Slider(1, range=1..100)

# ---- group: Cartesian Targets / Target from Frame
xy = XYPlane(Origin=pt)
panel = Panel("AlignedWithWorld")
target = Target(Object_Alias=panel, Object_Frame=xy, InWorld=True, _0_0=panel, _1_0=xy, Mode=0, RunInBackground=False, nickName="Target")

# ---- group: Targets from Curve / Curve to Targets
target_2 = Target(
    Alias="Curve",
    Curve=crv,
    Discretization={halEnum=1, halEnumType="HAL.McNeel.RhinoCommon5.Spatial.CurveDiscretization"},
    ToleranceMm=number_slider,
    InWorld=True,
    _1_0=crv,
    _3_0=number_slider,
    Mode=0,
    RunInBackground=False,
    nickName="Target")  # -> Object_Target, Trace

# ---- group: Cartesian Targets / Target Facing Down Shortcut
pt_2 = Point(pt, isNickNameImplied=True)

# ---- group: Monkey: Curve → Filter(50mm) → Move
filter = TargetFilter(
    Object_Target=target_2.Object_Target,
    PositionMm=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,
    OrientationRad=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,
    _0_0=target_2,
    Mode=0,
    RunInBackground=False,
    nickName="Filter")  # -> Object_Remaining, Object_Discarded, Object_Mask
move = Move(Object_Target=filter.Object_Remaining, _1_0=filter, Mode=0, RunInBackground=False, nickName="Move")

# ---- group: Joint Target / Target from Joint Positions
target_3 = Target(Mechanism=robot, Object_Position=merge, _1_0=robot, _2_0=merge, Mode=0, RunInBackground=False, nickName="Target")

# ---- group: Monkey: Cartesian Target → Move
move_2 = Move(Object_Target=target, _1_0=target, Mode=0, RunInBackground=False, nickName="Move")

# ---- group: Monkey: Joint Target → Move
move_3 = Move(Object_Target=target_3, _1_0=target_3, Mode=0, RunInBackground=False, nickName="Move")

# ----
merge_2 = Merge(Data1=flatten(move_2), Data2=flatten(move_3), Data3=flatten(move))
combine = CombineActions(Object_Combined=merge_2, Compact=True, _1_0=merge_2, Mode=0, RunInBackground=False, nickName="Combine")

# ---- group: Monkey: 3-Way Combine → Controller
controller = GenericController(Object_Procedure=combine, _2_0=combine, Mode=0, RunInBackground=False, nickName="Controller")
