# Grasshopper definition 1.1 - Getting Started [Mar-29 '26, 2351].gh (Grasshopper 1.0.8)
# plug-ins: HAL for Grasshopper

sessionsettings = SessionSettings()  # -> Data, DefaultSettings

# ---- group: Cell
robot = Robot(
    Alias="Robot",
    Mode=0,
    RunInBackground=False,
    catalogItem="Mechanism,1ee2801b-9834-4b40-a6d4-d961b1583ad5",
    nickName="⧉ Robot")
tool = Tool(
    Alias="Tool",
    Mode=0,
    RunInBackground=False,
    catalogItem="Mechanism,fc7cd139-36d8-4077-8243-979120a55716",
    nickName="⧉ Tool")
attach = OBSOLETEAttach(
    Alias="Composite Mechanism",
    Parent=robot,
    Child=tool,
    IsEndEffector=True,
    InWorld=True,
    _1_0=robot,
    _2_0=tool,
    Mode=0,
    RunInBackground=False,
    nickName="Attach")

# ---- group: Program
crv = Curve(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)
target = Target(
    Alias="Curve",
    Curve=crv,
    Discretization={halEnum=1, halEnumType="HAL.McNeel.RhinoCommon5.Spatial.CurveDiscretization"},
    ToleranceMm=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,
    InWorld=True,
    _1_0=crv,
    Mode=0,
    RunInBackground=False,
    nickName="Target")  # -> Object_Target, Trace
move = Move(Object_Target=target.Object_Target, _1_0=target, Mode=0, RunInBackground=False, nickName="Move")

# ----
controller = Controller(
    Alias="Custom controller",
    Object_Mechanism=attach,
    Object_Procedure=move,
    _2_0=attach,
    _3_0=move,
    Mode=0,
    RunInBackground=False,
    catalogItem="Controller,c391cd57-4094-4b53-9bc4-fc3816805551",
    nickName="⧉ Controller")

# ---- group: Simulate
solve = BooleanToggle(False)
solve_2 = OBSOLETEProcedureSolver(Controller=controller, Solve=solve, Mode=0, RunInBackground=True)  # -> Solution, Object_Solved, Notification
execution_control = ExecutionControl(Loop=True, TimeRatio=1)
execute = OBSOLETEExecute(
    ExecutionControl=execution_control,
    Solution=solve_2.Solution,
    displayEnvironment=True,
    displayMechanisms=True,
    displayTrace=True)
