# Grasshopper definition 2.6 - Create a Multi-Part Tool [Mar-29 '26, 2023].gh (Grasshopper 1.0.8)
# plug-ins: HAL for Grasshopper

sessionsettings = SessionSettings()  # -> Data, DefaultSettings

# ---- group: Prepare Part Geometry / Interface Plate Geometry
interface_plate = Brep([<brep referenced from the Rhino model> x7])
mesh = Mesh(B=interface_plate)
interface_plate_2 = Mesh(mesh)

# ---- group: Prepare Part Geometry / Gripper Geometry
gripper = Brep([<brep referenced from the Rhino model> x8])
mesh_2 = Mesh(B=gripper)
gripper_2 = Mesh(mesh_2)

# ---- group: Prepare Part Geometry / Camera Geometry
camera = Brep([<brep referenced from the Rhino model> x2])
mesh_3 = Mesh(B=camera)
camera_2 = Mesh(mesh_3)

# ---- group: Prepare Frames / Gripper Base Location
vec = VectorXYZ(XComponent=0, YComponent=0, ZComponent="20")  # -> Vector, Length
xy = XYPlane(Origin=vec.Vector)
gripper_base_frame = Plane(xy)

# ---- group: Prepare Frames / Camera Base Location
panel = Panel("15")
panel_2 = Panel("-67.5")
eulerframe = EulerFrame(
    XMm=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,
    YMm=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,
    ZMm=panel,
    AxisA={halEnum=2, halEnumType="HAL.Spatial.Axis"},
    AxisB={halEnum=1, halEnumType="HAL.Spatial.Axis"},
    AxisC={halEnum=0, halEnumType="HAL.Spatial.Axis"},
    AngleA=panel_2,
    AngleBRad=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,
    AngleCRad=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,
    _2_0=panel,
    _6_0=panel_2,
    Mode=0,
    RunInBackground=False,
    nickName="EulerFrame")
camera_base_frame = Plane(eulerframe)

# ---- group: Prepare Frames / Gripper TCP Frame
vec_2 = VectorXYZ(XComponent=0, YComponent=0, ZComponent="150")  # -> Vector, Length
xy_2 = XYPlane(Origin=vec_2.Vector)
gripper_tcp_frame = Plane(xy_2)

# ---- group: Prepare Frames / Camera TCP Frame
pt = Point(Point(-22.96100594, 55.43277195, 41.25))
panel_3 = Panel("-67.5")
eulerframe_2 = EulerFrame(
    Origin=pt,
    AxisA={halEnum=2, halEnumType="HAL.Spatial.Axis"},
    AxisB={halEnum=1, halEnumType="HAL.Spatial.Axis"},
    AxisC={halEnum=0, halEnumType="HAL.Spatial.Axis"},
    AngleA=panel_3,
    AngleBRad=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,
    AngleCRad=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,
    _0_0=pt,
    _4_0=panel_3,
    Mode=0,
    RunInBackground=False,
    nickName="EulerFrame")
camera_tcp_frame = Plane(eulerframe_2)

# ---- group: Prepare Frames / Interface Plate Location
xy_3 = XYPlane(Origin=Point(0, 0, 0))
interface_plate_frame = Plane(xy_3)

# ---- group: Assemble Single Part Tool / Mono-Part Body
interface_plate_3 = Mesh(interface_plate_2)
gripper_3 = Mesh(gripper_2)
camera_3 = Mesh(camera_2)
interface_plate_frame_2 = Plane(interface_plate_frame)
merge = Merge(Data1=flatten(interface_plate_3), Data2=flatten(gripper_3), Data3=flatten(camera_3))
panel_4 = Panel("ToolBody")
part = MechanicalPart(
    Alias=panel_4,
    Frame=interface_plate_frame_2,
    Object_Body=merge,
    _0_0=panel_4,
    _1_0=interface_plate_frame_2,
    _2_0=merge,
    Mode=0,
    RunInBackground=False,
    nickName="Part")
toolbody = Part(part, isNickNameImplied=True)

# ---- group: Assemble Multi-Part Tool / Camera Part
camera_4 = Mesh(camera_2)
swatch = ColourSwatch(SwatchColor=RGB(255, 183, 0))
camera_base_frame_2 = Plane(camera_base_frame)
panel_5 = Panel("Camera")
part_2 = Part(
    Alias=panel_5,
    Frame=camera_base_frame_2,
    Object_Body=camera_4,
    Object_Color=swatch,
    _0_0=panel_5,
    _1_0=camera_base_frame_2,
    _2_0=camera_4,
    _3_0=swatch,
    Mode=0,
    RunInBackground=False,
    nickName="Part")
camera_5 = Part(part_2, isNickNameImplied=True)

# ---- group: Assemble Multi-Part Tool / Gripper Part
swatch_2 = ColourSwatch(SwatchColor=RGB(0, 191, 255))
gripper_base_frame_2 = Plane(gripper_base_frame)
gripper_4 = Mesh(gripper_2)
panel_6 = Panel("Gripper")
part_3 = Part(
    Alias=panel_6,
    Frame=gripper_base_frame_2,
    Object_Body=gripper_4,
    Object_Color=swatch_2,
    _0_0=panel_6,
    _1_0=gripper_base_frame_2,
    _2_0=gripper_4,
    _3_0=swatch_2,
    Mode=0,
    RunInBackground=False,
    nickName="Part")
gripper_5 = Part(part_3, isNickNameImplied=True)

# ---- group: Assemble Multi-Part Tool / Interface Plate Part
interface_plate_frame_3 = Plane(interface_plate_frame)
interface_plate_4 = Mesh(interface_plate_2)
panel_7 = Panel("InterfacePlate")
part_4 = MechanicalPart(
    Alias=panel_7,
    Frame=interface_plate_frame_3,
    Object_Body=interface_plate_4,
    _0_0=panel_7,
    _1_0=interface_plate_frame_3,
    _2_0=interface_plate_4,
    Mode=0,
    RunInBackground=False,
    nickName="Part")
interface_plate_5 = Part(part_4, isNickNameImplied=True)

# ---- group: Assemble Multi-Part Tool / Connect Camera to Plate
camera_6 = Part(camera_5, isNickNameImplied=True)
interface_plate_6 = Part(interface_plate_5, isNickNameImplied=True)
camera_base_frame_3 = Plane(camera_base_frame)
panel_8 = Panel("ConnectCamera")
connection = Connection(
    Alias=panel_8,
    From=interface_plate_6,
    To=camera_6,
    Frame=camera_base_frame_3,
    InWorld=True,
    IsEndPoint=False,
    _0_0=panel_8,
    _1_0=interface_plate_6,
    _2_0=camera_6,
    _3_0=camera_base_frame_3,
    Mode=0,
    RunInBackground=False,
    nickName="Connection")

# ---- group: Assemble Multi-Part Tool / Connect Gripper to Camera
camera_7 = Part(camera_5, isNickNameImplied=True)
gripper_base_frame_3 = Plane(gripper_base_frame)
gripper_6 = Part(gripper_5, isNickNameImplied=True)
panel_9 = Panel("ConnectGripper")
connection_2 = Connection(
    Alias=panel_9,
    From=camera_7,
    To=gripper_6,
    Frame=gripper_base_frame_3,
    InWorld=True,
    IsEndPoint=False,
    _0_0=panel_9,
    _1_0=camera_7,
    _2_0=gripper_6,
    _3_0=gripper_base_frame_3,
    Mode=0,
    RunInBackground=False,
    nickName="Connection")

# ---- group: Assemble Multi-Part Tool
gripper_7 = Part(gripper_5, isNickNameImplied=True)

# ---- group: Assemble Multi-Part Tool / Set Gripper TCP
gripper_tcp_frame_2 = Plane(gripper_tcp_frame)
panel_10 = Panel("GripperTCP")
connection_3 = Connection(
    Alias=panel_10,
    From=gripper_7,
    Frame=gripper_tcp_frame_2,
    InWorld=True,
    IsEndPoint=invert(False),
    _0_0=panel_10,
    _1_0=gripper_7,
    _3_0=gripper_tcp_frame_2,
    Mode=0,
    RunInBackground=False,
    nickName="Connection")

# ---- group: Assemble Multi-Part Tool / Set Camera TCP
toolbody_2 = Part(interface_plate_5, isNickNameImplied=True)
camera_tcp_frame_2 = Plane(camera_tcp_frame)
panel_11 = Panel("CameraTCP")
connection_4 = Connection(
    Alias=panel_11,
    From=toolbody_2,
    Frame=camera_tcp_frame_2,
    InWorld=True,
    IsEndPoint=invert(False),
    _0_0=panel_11,
    _1_0=toolbody_2,
    _3_0=camera_tcp_frame_2,
    Mode=0,
    RunInBackground=False,
    nickName="Connection")

# ---- group: Assemble Single Part Tool / Set Gripper TCP
toolbody_3 = Part(toolbody, isNickNameImplied=True)
gripper_tcp_frame_3 = Plane(gripper_tcp_frame)
panel_12 = Panel("GripperTCP")
connection_5 = Connection(
    Alias=panel_12,
    From=toolbody_3,
    Frame=gripper_tcp_frame_3,
    InWorld=True,
    IsEndPoint=invert(False),
    _0_0=panel_12,
    _1_0=toolbody_3,
    _3_0=gripper_tcp_frame_3,
    Mode=0,
    RunInBackground=False,
    nickName="Connection")

# ---- group: Assemble Single Part Tool / Set Camera TCP
toolbody_4 = Part(toolbody, isNickNameImplied=True)
camera_tcp_frame_3 = Plane(camera_tcp_frame)
panel_13 = Panel("CameraTCP")
connection_6 = Connection(
    Alias=panel_13,
    From=toolbody_4,
    Frame=camera_tcp_frame_3,
    InWorld=True,
    IsEndPoint=invert(False),
    _0_0=panel_13,
    _1_0=toolbody_4,
    _3_0=camera_tcp_frame_3,
    Mode=0,
    RunInBackground=False,
    nickName="Connection")

# ---- group: Assemble Multi-Part Tool / Merge Ensuring Base Part is First
interface_plate_7 = Part(interface_plate_5, isNickNameImplied=True)
camera_8 = Part(camera_5, isNickNameImplied=True)
gripper_8 = Part(gripper_5, isNickNameImplied=True)
merge_2 = Merge(
    Data1=flatten(interface_plate_7),
    Data2=flatten(camera_8),
    Data3=flatten(gripper_8),
    Data4=flatten(connection),
    Data5=flatten(connection_2),
    Data6=flatten(connection_3),
    Data7=flatten(connection_4))

# ---- group: Assemble Single Part Tool / Merge Ensuring Base Part is First
toolbody_5 = Part(toolbody, isNickNameImplied=True)
merge_3 = Merge(Data1=flatten(toolbody_5), Data2=flatten(connection_5), Data3=flatten(connection_6))

# ---- group: Assemble Multi-Part Tool / Assemble Tool
panel_14 = Panel("MyTool")
assemble = OBSOLETEAssemble(
    Alias=panel_14,
    Object_Component=merge_2,
    _0_0=panel_14,
    _1_0=merge_2,
    Mode=0,
    RunInBackground=False,
    nickName="Assemble")

# ---- group: Assemble Single Part Tool / Assemble Tool
panel_15 = Panel("MyMergedTool")
assemble_2 = OBSOLETEAssemble(
    Alias=panel_15,
    Object_Component=merge_3,
    _0_0=panel_15,
    _1_0=merge_3,
    Mode=0,
    RunInBackground=False,
    nickName="Assemble")

# ==== cluster Mesh
B = ClusterInput()
jagged = SettingsSpeed()
mesh = MeshBrep(Brep=B, Settings=jagged)
M = ClusterOutput(mesh)
session_settings = SessionSettings()
