# Grasshopper definition 2.7 - Create a Positioner [Mar-29 '26, 2028].gh (Grasshopper 1.0.8)
# plug-ins: HAL for Grasshopper

# ---- group: Points from Model
headstock_cor = Point(<point referenced from the Rhino model>)
swing_arm_cor = Point(<point referenced from the Rhino model>)
plate_cor = Point(<point referenced from the Rhino model>)
flange_point = Point(<point referenced from the Rhino model>)

# ---- group: Construct Planes
xy = XYPlane(Origin=plate_cor)
xy_2 = XYPlane(Origin=flange_point)
Z = UnitZ(Factor=1)
pl = ConstructPlane(Origin=swing_arm_cor, XAxis=Z, YAxis=Vector(0, 1, 0))
rotate = Rotate(Geometry=xy, Angle=3.141592654, Plane=xy)  # -> Geometry, Transform
rotate_2 = Rotate(Geometry=xy_2, Angle=3.141592654, Plane=xy_2)  # -> Geometry, Transform
xy_3 = XYPlane(Origin=Point(0, 0, 0))
xy_4 = XYPlane(Origin=headstock_cor)

# ----
# Mini Datasheet: ABB IRBP A-250
# 
# Joint 1
#   - Min. Position: -181 deg
#   - Max. Position: +181 deg
#   - Max. Speed: 150 deg/s
# 
# Joint 2
#   - Min. Position: -3600 deg
#   - Max. Position: +3600 deg
#   - Max. Speed: 180 deg/s
# 
# https://search-ext.abb.com/library/Download.aspx?DocumentID=ROB10080EN_R3&LanguageCode=en&DocumentPartId=&Action=Launch
# 
# Ensure direction of joints by flipping frames
sessionsettings = SessionSettings()  # -> Data, DefaultSettings

# ---- group: Meshes
base_mesh = Mesh(<mesh referenced from the Rhino model>)
headstock_mesh = Mesh(<mesh referenced from the Rhino model>)
swing_arm_mesh = Mesh([<mesh referenced from the Rhino model> x3])
plate_mesh = Mesh(<mesh referenced from the Rhino model>)

# ---- group: Planes
base_plane = Plane(xy_3)
headstock_plane = Plane(xy_4)
swing_arm_plane = Plane(pl)
plate_plane = Plane(rotate.Geometry)
flange_plane = Plane(rotate_2.Geometry)

# ----
swing_arm_mesh_2 = Mesh(swing_arm_mesh)
headstock_mesh_2 = Mesh(headstock_mesh)
plate_mesh_2 = Mesh(plate_mesh)
base_mesh_2 = Mesh(base_mesh)

swing_arm_plane_2 = Plane(swing_arm_plane)
headstock_plane_2 = Plane(headstock_plane)
flange_plane_2 = Plane(flange_plane)
base_plane_2 = Plane(base_plane)
plate_plane_2 = Plane(plate_plane)

# ---- group: Parts
swing_arm_plane_3 = Plane(swing_arm_plane)
headstock_plane_3 = Plane(headstock_plane)
headstock_mesh_3 = Mesh(headstock_mesh)
base_plane_3 = Plane(base_plane)
base_mesh_3 = Mesh(base_mesh)
arm_mesh = Mesh(swing_arm_mesh)
plate_plane_3 = Plane(plate_plane)
plate_mesh_3 = Mesh(plate_mesh)
panel = Panel("Base")
part = MechanicalPart(
    Alias=panel,
    Frame=base_plane_3,
    Object_Body=base_mesh_3,
    _0_0=panel,
    _1_0=base_plane_3,
    _2_0=base_mesh_3,
    Mode=0,
    RunInBackground=False,
    nickName="Part")
panel_2 = Panel("Swing Arm")
part_2 = MechanicalPart(
    Alias=panel_2,
    Frame=swing_arm_plane_3,
    Object_Body=arm_mesh,
    _0_0=panel_2,
    _1_0=swing_arm_plane_3,
    _2_0=arm_mesh,
    Mode=0,
    RunInBackground=False,
    nickName="Part")
panel_3 = Panel("Headstock")
part_3 = MechanicalPart(
    Alias=panel_3,
    Frame=headstock_plane_3,
    Object_Body=headstock_mesh_3,
    _0_0=panel_3,
    _1_0=headstock_plane_3,
    _2_0=headstock_mesh_3,
    Mode=0,
    RunInBackground=False,
    nickName="Part")
panel_4 = Panel("Plate")
part_4 = MechanicalPart(
    Alias=panel_4,
    Frame=plate_plane_3,
    Object_Body=plate_mesh_3,
    _0_0=panel_4,
    _1_0=plate_plane_3,
    _2_0=plate_mesh_3,
    Mode=0,
    RunInBackground=False,
    nickName="Part")

# ---- group: Joints and Connections
swing_arm_plane_4 = Plane(swing_arm_plane)
headstock_plane_4 = Plane(headstock_plane)
flange_plane_3 = Plane(flange_plane)
plate_plane_4 = Plane(plate_plane)
panel_5 = Panel("-181")
panel_6 = Panel("181")
panel_7 = Panel("150")
panel_8 = Panel("-3600")
panel_9 = Panel("3600")
panel_10 = Panel("180")
panel_11 = Panel("MechanicalJoint")
panel_12 = Panel("J1")
revolutejoint = OBSOLETERevoluteJoint(
    Alias=panel_12,
    From=part_3,
    To=part_2,
    Frame=swing_arm_plane_4,
    PositionRad=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,
    MinPosition=panel_5,
    MaxPosition=panel_6,
    MaxSpeedS=panel_7,
    Mapping=-1,
    _0_0=panel_12,
    _1_0=part_3,
    _2_0=part_2,
    _3_0=swing_arm_plane_4,
    _5_0=panel_5,
    _6_0=panel_6,
    _7_0=panel_7,
    Mode=0,
    RunInBackground=False,
    nickName="RevoluteJoint")
panel_13 = Panel("J2")
revolutejoint_2 = OBSOLETERevoluteJoint(
    Alias=panel_13,
    From=part_2,
    To=part_4,
    Frame=plate_plane_4,
    PositionRad=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,
    MinPosition=panel_8,
    MaxPosition=panel_9,
    MaxSpeedS=panel_10,
    Mapping=-1,
    _0_0=panel_13,
    _1_0=part_2,
    _2_0=part_4,
    _3_0=plate_plane_4,
    _5_0=panel_8,
    _6_0=panel_9,
    _7_0=panel_10,
    Mode=0,
    RunInBackground=False,
    nickName="RevoluteJoint")
panel_14 = Panel("Flange")
connection = Connection(
    Alias=panel_14,
    From=part_4,
    Frame=flange_plane_3,
    IsEndPoint=invert(False),
    _0_0=panel_14,
    _1_0=part_4,
    _3_0=flange_plane_3,
    Mode=0,
    RunInBackground=False,
    nickName="Connection")
connection_2 = Connection(
    Alias=panel_11,
    From=part,
    To=part_3,
    Frame=headstock_plane_4,
    InWorld=True,
    IsEndPoint=False,
    _0_0=panel_11,
    _1_0=part,
    _2_0=part_3,
    _3_0=headstock_plane_4,
    Mode=0,
    RunInBackground=False,
    nickName="Connection")

# ---- group: Assembly
merge = Merge(
    Data1=part,
    Data2=connection_2,
    Data3=part_3,
    Data4=revolutejoint,
    Data5=part_2,
    Data6=revolutejoint_2,
    Data7=part_4,
    Data8=connection)
panel_15 = Panel(merge)
assemble = OBSOLETEAssemble(Alias="Generic Mechanism", Object_Component=merge, _1_0=merge, Mode=0, RunInBackground=False, nickName="Assemble")
panel_16 = Panel("IRBP A-250")

# ---- group: Test Target
merge_2 = Merge(Data1=Slider(26, range=-180..180), Data2=Slider(40, range=-180..180))
rad = Radians(Degrees=merge_2)
target = Target(Mechanism=assemble, Object_Position=rad, _1_0=assemble, _2_0=rad, Mode=0, RunInBackground=False, nickName="Target")

# ---- group: Program and Simulate
dom = ConstructDomain(DomainStart=-180, DomainEnd=180)
panel_17 = Panel("""1
34""")
irbp_a_250 = Mechanism(assemble, isNickNameImplied=True)
target_2 = Target(target, isNickNameImplied=True)
random = Random(Range=dom, Number=5, Seed=panel_17)
flip = FlipMatrix(Data=random)
irbp_a_250_2 = Mechanism(irbp_a_250, isNickNameImplied=True)
rad_2 = Radians(Degrees=flip)
target_3 = Target(
    Mechanism=irbp_a_250_2,
    Object_Position=rad_2,
    _1_0=irbp_a_250_2,
    _2_0=rad_2,
    Mode=0,
    RunInBackground=False,
    nickName="Target")  # -> flatten(Target)
motionsettings = OBSOLETEMotionSettings(
    Space={halEnum=1, halEnumType="HAL.Motion.Settings.MotionSpace"},
    Mode=0,
    RunInBackground=False,
    nickName="MotionSettings")
merge_3 = Merge(Data1=flatten(target_2), Data2=flatten(target_3))
move = Move(
    Object_Target=merge_3,
    Object_MotionSettings=motionsettings,
    _1_0=merge_3,
    _2_0=motionsettings,
    Mode=0,
    RunInBackground=False,
    nickName="Move")
irbp_a_250_3 = Mechanism(irbp_a_250, isNickNameImplied=True)
controller = Controller(
    Alias="Custom controller",
    Object_Mechanism=irbp_a_250_3,
    Object_Procedure=move,
    _2_0=irbp_a_250_3,
    _3_0=move,
    Mode=0,
    RunInBackground=False,
    catalogItem="Controller,3169879c-d516-4db0-9e63-03018ff58094",
    nickName="⧉ Controller")
solve = BooleanToggle(True)
solve_2 = OBSOLETEProcedureSolver(Controller=controller, Solve=solve, Mode=0, RunInBackground=True)  # -> Solution, Object_Solved, Notification
execution_control = ExecutionControl(Loop=False, TimeRatio=1)
execute = OBSOLETEExecute(
    ExecutionControl=execution_control,
    Solution=solve_2.Solution,
    displayEnvironment=True,
    displayMechanisms=True,
    displayTrace=True)
