# Grasshopper definition 3.10 - Using a Track [Mar-29 '26, 2032].gh (Grasshopper 1.0.8)
# plug-ins: HAL for Grasshopper

sessionsettings = SessionSettings()  # -> Data, DefaultSettings

# ---- group: Cell / Robot
xy = XYPlane(Origin=Point(0, 0, 0))
mesh = Mesh([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])
number_slider = Slider(5, range=0..10)
pln = Plane(PlaneXY(-35, -20.5, 939.2005707))
panel = Panel("HWCutter")
tool = Tool(
    Alias=panel,
    Frame=xy,
    Object_Body=mesh,
    MassKg=number_slider,
    ToolFrame=pln,
    _0_0=panel,
    _1_0=xy,
    _2_0=mesh,
    _4_0=number_slider,
    _6_0=pln,
    Mode=0,
    RunInBackground=False,
    nickName="Tool")

# ---- group: Motion Settings / Joint Motion
joint = Space({halEnum=1, halEnumType="HAL.Motion.Settings.MotionSpace"}, EnumerationType="MotionSpace", isNickNameImplied=True)
panel_2 = Panel("JointMove")
motionsettings = OBSOLETEMotionSettings(Alias=panel_2, Space=joint, _0_0=panel_2, _1_0=joint, Mode=0, RunInBackground=False, nickName="MotionSettings")
jointmotion = MotionSettings(motionsettings, isNickNameImplied=True)

# ---- group: Cell / Track
number_slider_2 = Slider(9, range=0..10)
positioner = Positioner(
    Alias="Positioner",
    Object_Mapping=number_slider_2,
    _3_0=number_slider_2,
    Mode=0,
    RunInBackground=False,
    catalogItem="Mechanism,99c5fe3a-9640-4f7a-aea5-0ff29234cba7",
    nickName="⧉ Positioner")

# ---- group: Cell / Robot
robot = Robot(
    Alias="Robot",
    Mode=0,
    RunInBackground=False,
    catalogItem="Mechanism,21a4ab80-ad90-421c-915d-e944c9e37563",
    nickName="⧉ Robot")
attach = OBSOLETEAttach(
    Alias="Composite Mechanism",
    Parent=robot,
    Child=tool,
    IsEndEffector=True,
    InWorld=True,
    _1_0=robot,
    _2_0=tool,
    Mode=0,
    RunInBackground=False,
    nickName="Attach")

# ---- group: Cell
panel_3 = Panel("Track+Robot")
attach_2 = OBSOLETEAttach(
    Alias=panel_3,
    Parent=positioner,
    Child=attach,
    IsEndEffector=True,
    InWorld=True,
    _0_0=panel_3,
    _1_0=positioner,
    _2_0=attach,
    Mode=0,
    RunInBackground=False,
    nickName="Attach")

# ---- group: Cell / Disassembly
disassemble = OBSOLETEDisassemble(Mechanism=attach_2, _0_0=attach_2, Mode=0, RunInBackground=False, nickName="Disassemble")  # -> Base, Object_Part, Object_Joint, Object_Connection, ActiveEndPoint, EndEffector, Object_SubMechanism, Object_Persistence
item = ListItem(List=disassemble.Object_SubMechanism, Index=0, Wrap=True)  # -> Item, Item1
track = Mechanism(item.Item, isNickNameImplied=True)
robot_2 = Mechanism(item.Item1, isNickNameImplied=True)

# ---- group: Motion Settings / KinematicSettings
track_2 = Mechanism(track, isNickNameImplied=True)
robot_3 = Mechanism(robot_2, isNickNameImplied=True)
kinematics = KinematicSettings(Mechanism=track_2, _1_0=track_2, Mode=0, RunInBackground=False, nickName="Kinematics")
kinematics_2 = KinematicSettings(Mechanism=robot_3, _1_0=robot_3, Mode=0, RunInBackground=False, nickName="Kinematics")
kinematics_3 = KinematicSettings(
    Primary=kinematics,
    Object_Secondary=kinematics_2,
    _1_0=kinematics,
    _2_0=kinematics_2,
    Mode=0,
    RunInBackground=False,
    nickName="Kinematics")
kinematicsettings = KinematicSettings(kinematics_3, isNickNameImplied=True)

# ---- group: Motion Settings / RobotCartesianMove
kinematicsettings_2 = KinematicSettings(kinematicsettings, isNickNameImplied=True)
cartesian = Space({halEnum=0, halEnumType="HAL.Motion.Settings.MotionSpace"}, EnumerationType="MotionSpace", isNickNameImplied=True)
panel_4 = Panel("RobotMove")
motionsettings_2 = OBSOLETEMotionSettings(
    Alias=panel_4,
    Space=cartesian,
    Kinematics=kinematicsettings_2,
    _0_0=panel_4,
    _1_0=cartesian,
    _5_0=kinematicsettings_2,
    Mode=0,
    RunInBackground=False,
    nickName="MotionSettings")
robotmotion = MotionSettings(motionsettings_2, isNickNameImplied=True)

# ---- group: Motion Settings / TrackJointMove
kinematicsettings_3 = KinematicSettings(kinematicsettings, isNickNameImplied=True)
joint_2 = Space({halEnum=1, halEnumType="HAL.Motion.Settings.MotionSpace"}, EnumerationType="MotionSpace", isNickNameImplied=True)
panel_5 = Panel("TrackMove")
motionsettings_3 = OBSOLETEMotionSettings(
    Alias=panel_5,
    Space=joint_2,
    Kinematics=kinematicsettings_3,
    _0_0=panel_5,
    _1_0=joint_2,
    _5_0=kinematicsettings_3,
    Mode=0,
    RunInBackground=False,
    nickName="MotionSettings")
trackmotion = MotionSettings(motionsettings_3, isNickNameImplied=True)

# ---- group: Robot Procedure / InitRobot
merge = Merge(
    Data1=Slider(64, range=-180..180),
    Data2=Slider(11, range=-180..180),
    Data3=Slider(-11, range=-180..180),
    Data4=Slider(0, range=-180..180),
    Data5=Slider(90, range=-180..180),
    Data6=Slider(-36, range=-180..180))
rad = Radians(Degrees=merge)
robot_4 = Mechanism(robot_2, isNickNameImplied=True)
target = Target(Mechanism=robot_4, Object_Position=rad, _1_0=robot_4, _2_0=rad, Mode=0, RunInBackground=False, nickName="Target")
jointmotion_2 = MotionSettings(jointmotion, isNickNameImplied=True)
panel_6 = Panel("InitRobot")
move = Move(
    Alias=panel_6,
    Object_Target=target,
    Object_MotionSettings=jointmotion_2,
    _0_0=panel_6,
    _1_0=target,
    _2_0=jointmotion_2,
    Mode=0,
    RunInBackground=False,
    nickName="Move")

# ---- group: Robot Procedure / FollowCurve
inputcrv = Curve(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)
Y = UnitY(Factor=expr("-x", 1))
panel_7 = Panel("SyncCurve")
robotmotion_2 = MotionSettings(robotmotion, isNickNameImplied=True)
sync = SyncSettings(Alias=panel_7, _0_0=panel_7, Mode=0, RunInBackground=False, nickName="Sync")
panel_8 = Panel("FollowCurve")

# ---- group: Robot Procedure
panel_9 = Panel("5")
panel_10 = Panel("RobotProgram")

# ---- group: Robot Procedure / FollowCurve (continued)
target_2 = Target(
    Alias="Curve",
    Curve=inputcrv,
    Discretization={halEnum=1, halEnumType="HAL.McNeel.RhinoCommon5.Spatial.CurveDiscretization"},
    ToleranceMm=panel_9,
    InWorld=True,
    _1_0=inputcrv,
    _3_0=panel_9,
    Mode=0,
    RunInBackground=False,
    nickName="Target")  # -> Object_Target, Trace
parallel = Parallel(
    Target=target_2.Object_Target,
    Direction=Y,
    Axis={halEnum=0, halEnumType="HAL.Spatial.Axis"},
    Flip=False,
    Project=False,
    _0_0=target_2,
    _2_0=Y,
    Mode=0,
    RunInBackground=False,
    nickName="Parallel")
move_2 = Move(
    Alias=panel_8,
    Object_Target=parallel,
    Object_MotionSettings=robotmotion_2,
    Object_Sync=sync,
    _0_0=panel_8,
    _1_0=parallel,
    _2_0=robotmotion_2,
    _3_0=sync,
    Mode=0,
    RunInBackground=False,
    nickName="Move")

# ---- group: Track Procedure
number_slider_3 = Slider(2500, range=0..50000)
offset = OBSOLETEOffsetTargetResolver(OffsetMm=number_slider_3, Average=True, _0_0=number_slider_3, Mode=0, RunInBackground=False, nickName="Offset")
trackmotion_2 = MotionSettings(trackmotion, isNickNameImplied=True)
panel_11 = Panel("TrackMotion")
synchronized = Synchronized(
    Alias=panel_11,
    Procedure=move_2,
    Target=offset,
    MotionSettings=trackmotion_2,
    _0_0=panel_11,
    _1_0=move_2,
    _2_0=offset,
    _3_0=trackmotion_2,
    Mode=0,
    RunInBackground=False,
    nickName="Synchronized")
trackprocedure = Procedure(synchronized, isNickNameImplied=True)

# ---- group: Robot Procedure (continued)
merge_2 = Merge(Data1=flatten(move), Data2=flatten(move_2))
combine = CombineActions(
    Alias=panel_10,
    Object_Combined=merge_2,
    Compact=True,
    _0_0=panel_10,
    _1_0=merge_2,
    Mode=0,
    RunInBackground=False,
    nickName="Combine")
robotprocedure = Procedure(combine, isNickNameImplied=True)

# ---- group: Solve and Execute
robot_5 = Mechanism(robot_2, isNickNameImplied=True)
track_3 = Mechanism(track, isNickNameImplied=True)
trackprocedure_2 = Procedure(trackprocedure, isNickNameImplied=True)
robotprocedure_2 = Procedure(robotprocedure, isNickNameImplied=True)
merge_3 = Merge(Data1=flatten(track_3), Data2=flatten(robot_5))
merge_4 = Merge(Data1=flatten(trackprocedure_2), Data2=flatten(robotprocedure_2))
controller = Controller(
    Alias="Custom controller",
    Object_Mechanism=merge_3,
    Object_Procedure=merge_4,
    _2_0=merge_3,
    _3_0=merge_4,
    Mode=0,
    RunInBackground=False,
    catalogItem="Controller,1b9af5c9-6d85-4e9b-8ef7-4db7cdf413f1",
    nickName="⧉ Controller")
solve = BooleanToggle(True)
solve_2 = OBSOLETEProcedureSolver(Controller=controller, Solve=solve, Mode=0, RunInBackground=True)  # -> Solution, Object_Solved, Notification
execution_control = ExecutionControl(Loop=False, TimeRatio=3)
execute = OBSOLETEExecute(
    ExecutionControl=execution_control,
    Solution=solve_2.Solution,
    displayEnvironment=True,
    displayMechanisms=True,
    displayTrace=True)
