# Grasshopper definition 3.3 - Change Motion Settings [Mar-29 '26, 1428].gh (Grasshopper 1.0.8)
# plug-ins: HAL for Grasshopper

sessionsettings = SessionSettings()  # -> Data, DefaultSettings

# ---- group: Joint Target / Robot for Target
robot = Robot(
    Alias="Robot",
    Mode=0,
    RunInBackground=False,
    catalogItem="Mechanism,1ee2801b-9834-4b40-a6d4-d961b1583ad5",
    nickName="⧉ Robot")

# ---- group: Joint Target / Joint Values
merge = Merge(
    Data1=Slider(-0.377, range=-3.142..3.142),
    Data2=Slider(0.44, range=-3.142..3.142),
    Data3=Slider(0.314, range=-3.142..3.142),
    Data4=Slider(0, range=-3.142..3.142),
    Data5=Slider(0.754, range=-3.142..3.142),
    Data6=Slider(0, range=-3.142..3.142))

# ---- group: Targets from Curve / Curve to Follow
crv = Curve(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)

# ---- group: Targets from Curve
number_slider = Slider(5, range=1..100)

# ---- group: Targets from Curve / Curve to Targets
target = Target(
    Alias="Curve",
    Curve=crv,
    Discretization={halEnum=1, halEnumType="HAL.McNeel.RhinoCommon5.Spatial.CurveDiscretization"},
    ToleranceMm=number_slider,
    InWorld=True,
    _1_0=crv,
    _3_0=number_slider,
    Mode=0,
    RunInBackground=False,
    nickName="Target")  # -> Object_Target, Trace

# ---- group: Joint Target / Target from Joint Positions
target_2 = Target(Mechanism=robot, Object_Position=merge, _1_0=robot, _2_0=merge, Mode=0, RunInBackground=False, nickName="Target")

# ---- group: Cartesian Blended Processing / Slower Processing Settings
number_slider_2 = Slider(20, range=0..100)
number_slider_3 = Slider(20, range=0..1000)
number_slider_4 = Slider(5, range=0..10)
speed = SpeedSettings(
    PositionMmS=number_slider_3,
    OrientationRadS=number_slider_4,
    _1_0=number_slider_3,
    _2_0=number_slider_4,
    Mode=0,
    RunInBackground=False,
    nickName="Speed")
blend = BlendSettings(PositionMm=number_slider_2, _1_0=number_slider_2, Mode=0, RunInBackground=False, nickName="Blend")
panel = Panel("Process")
motionsettings = OBSOLETEMotionSettings(
    Alias=panel,
    Space={halEnum=0, halEnumType="HAL.Motion.Settings.MotionSpace"},
    Speed=speed,
    Blend=blend,
    _0_0=panel,
    _2_0=speed,
    _4_0=blend,
    Mode=0,
    RunInBackground=False,
    nickName="MotionSettings")

# ---- group: Joint Move to Known Starting Position / Fast Travel Settings
number_slider_5 = Slider(0, range=0..100)
number_slider_6 = Slider(1000, range=0..1000)
number_slider_7 = Slider(5, range=0..10)
speed_2 = SpeedSettings(
    PositionMmS=number_slider_6,
    OrientationRadS=number_slider_7,
    _1_0=number_slider_6,
    _2_0=number_slider_7,
    Mode=0,
    RunInBackground=False,
    nickName="Speed")
blend_2 = BlendSettings(
    PositionMm=number_slider_5,
    OrientationRad=number_slider_5,
    _1_0=number_slider_5,
    _2_0=number_slider_5,
    Mode=0,
    RunInBackground=False,
    nickName="Blend")
jointspace = Space({halEnum=1, halEnumType="HAL.Motion.Settings.MotionSpace"}, EnumerationType="MotionSpace", isNickNameImplied=True)
panel_2 = Panel("FastTravel")
motionsettings_2 = OBSOLETEMotionSettings(
    Alias=panel_2,
    Space=jointspace,
    Speed=speed_2,
    Blend=blend_2,
    _0_0=panel_2,
    _1_0=jointspace,
    _2_0=speed_2,
    _4_0=blend_2,
    Mode=0,
    RunInBackground=False,
    nickName="MotionSettings")

# ---- group: Cartesian Blended Processing
panel_3 = Panel("FollowCurve")
move = Move(
    Alias=panel_3,
    Object_Target=target.Object_Target,
    Object_MotionSettings=motionsettings,
    _0_0=panel_3,
    _1_0=target,
    _2_0=motionsettings,
    Mode=0,
    RunInBackground=False,
    nickName="Move")

# ---- group: Joint Move to Known Starting Position
panel_4 = Panel("Initialize")
move_2 = Move(
    Alias=panel_4,
    Object_Target=target_2,
    Object_MotionSettings=motionsettings_2,
    _0_0=panel_4,
    _1_0=target_2,
    _2_0=motionsettings_2,
    Mode=0,
    RunInBackground=False,
    nickName="Move")

# ---- group: Solve and Execute
merge_2 = Merge(Data1=flatten(move_2), Data2=flatten(move))
combine = CombineActions(Object_Combined=merge_2, Compact=True, _1_0=merge_2, Mode=0, RunInBackground=False, nickName="Combine")
mechanism = Mechanism(robot, isNickNameImplied=True)
controller = Controller(
    Alias="Custom controller",
    Object_Mechanism=mechanism,
    Object_Procedure=combine,
    _2_0=mechanism,
    _3_0=combine,
    Mode=0,
    RunInBackground=False,
    catalogItem="Controller,3169879c-d516-4db0-9e63-03018ff58094",
    nickName="⧉ Controller")
solve = BooleanToggle(True)
solve_2 = OBSOLETEProcedureSolver(Controller=controller, Solve=solve, Mode=0, RunInBackground=True)  # -> Solution, Object_Solved, Notification
execution_control = ExecutionControl(Loop=False, TimeRatio=1)
execute = OBSOLETEExecute(
    ExecutionControl=execution_control,
    Solution=solve_2.Solution,
    displayEnvironment=True,
    displayMechanisms=True,
    displayTrace=True)
