# Grasshopper definition 3.5 - Synchronize Motion [Mar-29 '26, 2031].gh (Grasshopper 1.0.8)
# plug-ins: HAL for Grasshopper

sessionsettings = SessionSettings()  # -> Data, DefaultSettings

# ---- group: Setup Cell
number_slider = Slider(1000, range=0..2000)
pi = Pi(Factor=1)
eulerframe = EulerFrame(
    XMm=number_slider,
    YMm=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,
    ZMm=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,
    AxisA={halEnum=2, halEnumType="HAL.Spatial.Axis"},
    AxisB={halEnum=1, halEnumType="HAL.Spatial.Axis"},
    AxisC={halEnum=0, halEnumType="HAL.Spatial.Axis"},
    AngleARad=pi,
    AngleBRad=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,
    AngleCRad=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,
    _0_0=number_slider,
    _6_0=pi,
    Mode=0,
    RunInBackground=False,
    nickName="EulerFrame")
panel = Panel("IRB1200-B")
robot = Robot(
    Alias=panel,
    Location=eulerframe,
    _0_0=panel,
    _1_0=eulerframe,
    Mode=0,
    RunInBackground=False,
    catalogItem="Mechanism,1ee2801b-9834-4b40-a6d4-d961b1583ad5",
    nickName="⧉ Robot")
irb1200_b = Mechanism(robot, isNickNameImplied=True)

# ---- group: Shared Settings / Joint Motion Settings
number_slider_2 = Slider(0, range=0..100)
number_slider_3 = Slider(1000, range=0..1000)
number_slider_4 = Slider(0.001, range=0..0.001)
speed = SpeedSettings(
    PositionMmS=number_slider_3,
    OrientationRadS=number_slider_3,
    _1_0=number_slider_3,
    _2_0=number_slider_3,
    Mode=0,
    RunInBackground=False,
    nickName="Speed")
blend = BlendSettings(
    PositionMm=number_slider_4,
    OrientationRad=number_slider_2,
    _1_0=number_slider_4,
    _2_0=number_slider_2,
    Mode=0,
    RunInBackground=False,
    nickName="Blend")
motionsettings = OBSOLETEMotionSettings(
    Space={halEnum=1, halEnumType="HAL.Motion.Settings.MotionSpace"},
    Speed=speed,
    Blend=blend,
    _2_0=speed,
    _4_0=blend,
    Mode=0,
    RunInBackground=False,
    nickName="MotionSettings")
jointmovesettings = MotionSettings(motionsettings, isNickNameImplied=True)

# ---- group: Setup Cell
panel_2 = Panel("IRB1200-A")
robot_2 = Robot(
    Alias=panel_2,
    _0_0=panel_2,
    Mode=0,
    RunInBackground=False,
    catalogItem="Mechanism,1ee2801b-9834-4b40-a6d4-d961b1583ad5",
    nickName="⧉ Robot")
irb1200_a = Mechanism(robot_2, isNickNameImplied=True)

# ---- group: Shared Settings / Sync Motions
panel_3 = Panel("SyncMove")
sync = SyncSettings(Alias=panel_3, _0_0=panel_3, Mode=0, RunInBackground=False, nickName="Sync")
syncmove = SyncSettings(sync, isNickNameImplied=True)

# ---- group: Program Robot B
merge = Merge(
    Data1=Slider(90, range=-180..180),
    Data2=Slider(0, range=-180..180),
    Data3=Slider(0, range=-180..180),
    Data4=Slider(0, range=-180..180),
    Data5=Slider(0, range=-180..180),
    Data6=Slider(0, range=-180..180))
irb1200_b_2 = Mechanism(irb1200_b, isNickNameImplied=True)
rad = Radians(Degrees=merge)
panel_4 = Panel("T1-B")
target = Target(
    Alias=panel_4,
    Mechanism=irb1200_b_2,
    Object_Position=rad,
    _0_0=panel_4,
    _1_0=irb1200_b_2,
    _2_0=rad,
    Mode=0,
    RunInBackground=False,
    nickName="Target")

# ---- group: Program Robot A
merge_2 = Merge(
    Data1=Slider(45, range=-180..180),
    Data2=Slider(0, range=-180..180),
    Data3=Slider(0, range=-180..180),
    Data4=Slider(0, range=-180..180),
    Data5=Slider(0, range=-180..180),
    Data6=Slider(0, range=-180..180))
irb1200_a_2 = Mechanism(irb1200_a, isNickNameImplied=True)
rad_2 = Radians(Degrees=merge_2)
panel_5 = Panel("T1-A")
target_2 = Target(
    Alias=panel_5,
    Mechanism=irb1200_a_2,
    Object_Position=rad_2,
    _0_0=panel_5,
    _1_0=irb1200_a_2,
    _2_0=rad_2,
    Mode=0,
    RunInBackground=False,
    nickName="Target")

# ---- group: Program Robot B
jointmovesettings_2 = MotionSettings(jointmovesettings, isNickNameImplied=True)
syncmove_2 = SyncSettings(syncmove, isNickNameImplied=True)
move = Move(
    Object_Target=target,
    Object_MotionSettings=jointmovesettings_2,
    Object_Sync=syncmove_2,
    _1_0=target,
    _2_0=jointmovesettings_2,
    _3_0=syncmove_2,
    Mode=0,
    RunInBackground=False,
    nickName="Move")

# ---- group: Program Robot A
jointmovesettings_3 = MotionSettings(jointmovesettings, isNickNameImplied=True)
syncmove_3 = SyncSettings(syncmove, isNickNameImplied=True)
move_2 = Move(
    Object_Target=target_2,
    Object_MotionSettings=jointmovesettings_3,
    Object_Sync=syncmove_3,
    _1_0=target_2,
    _2_0=jointmovesettings_3,
    _3_0=syncmove_3,
    Mode=0,
    RunInBackground=False,
    nickName="Move")

# ----
irb1200_a_3 = Mechanism(irb1200_a, isNickNameImplied=True)
irb1200_b_3 = Mechanism(irb1200_b, isNickNameImplied=True)
merge_3 = Merge(Data1=flatten(irb1200_a_3), Data2=flatten(irb1200_b_3))
merge_4 = Merge(Data1=flatten(move_2), Data2=flatten(move))
controller = Controller(
    Alias="Custom controller",
    Object_Mechanism=merge_3,
    Object_Procedure=merge_4,
    _2_0=merge_3,
    _3_0=merge_4,
    Mode=0,
    RunInBackground=False,
    catalogItem="Controller,3169879c-d516-4db0-9e63-03018ff58094",
    nickName="⧉ Controller")
solve = BooleanToggle(False)
solve_2 = OBSOLETEProcedureSolver(Controller=controller, Solve=solve, Mode=0, RunInBackground=True)  # -> Solution, Object_Solved, Notification
execution_control = ExecutionControl(Loop=False, TimeRatio=1)
execute = OBSOLETEExecute(
    ExecutionControl=execution_control,
    Solution=solve_2.Solution,
    displayEnvironment=True,
    displayMechanisms=True,
    displayTrace=True)
