# Grasshopper definition 3.6 - Resolve Targets [Mar-29 '26, 2031].gh (Grasshopper 1.0.8)
# plug-ins: HAL for Grasshopper

pt = Point("-1063.355, -949.1958, 587.2186")
pt_2 = Point(Point(-1011.369995, -1000, 1010))
sessionsettings = SessionSettings()  # -> Data, DefaultSettings

Z = UnitZ(Factor=expr("-x", 1))
platebase = Point(Point(-1052.87, -950, 960))
pl = ConstructPlane(Origin=platebase, XAxis=Z, YAxis=Vector(0, 1, 0))
mesh = Mesh(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)
panel = Panel("Plate")
part = MechanicalPart(Alias=panel, Frame=pl, Object_Body=mesh, _0_0=panel, _1_0=pl, _2_0=mesh, Mode=0, RunInBackground=False, nickName="Part")

# ---- group: Tool / AW PSF 25 TCP
number_slider = Slider(40, range=0..100)
pt_3 = ConstructPoint(XCoordinate="-0.817246", YCoordinate="2.32458", ZCoordinate="315.24")
eulerframe = EulerFrame(
    Origin=pt_3,
    AxisA={halEnum=2, halEnumType="HAL.Spatial.Axis"},
    AxisB={halEnum=1, halEnumType="HAL.Spatial.Axis"},
    AxisC={halEnum=0, halEnumType="HAL.Spatial.Axis"},
    AngleARad=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,
    AngleB=number_slider,
    AngleCRad=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,
    _0_0=pt_3,
    _5_0=number_slider,
    Mode=0,
    RunInBackground=False,
    nickName="EulerFrame")

# ----
supportbase = Point(Point(-1011.37, -950, 960))
Z_2 = UnitZ(Factor=1)
pl_2 = ConstructPlane(Origin=supportbase, XAxis=Z_2, YAxis=expr("-x", Vector(0, 1, 0)))
mesh_2 = Mesh([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])
panel_2 = Panel("Support")
part_2 = MechanicalPart(
    Alias=panel_2,
    Frame=pl_2,
    Object_Body=mesh_2,
    _0_0=panel_2,
    _1_0=pl_2,
    _2_0=mesh_2,
    Mode=0,
    RunInBackground=False,
    nickName="Part")

tailstockbase = Point(Point(-1129.586103, -950.3601406, 710))
xy = XYPlane(Origin=tailstockbase)
mesh_3 = Mesh(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)
panel_3 = Panel("TailStock")
part_3 = MechanicalPart(
    Alias=panel_3,
    Frame=xy,
    Object_Body=mesh_3,
    _0_0=panel_3,
    _1_0=xy,
    _2_0=mesh_3,
    Mode=0,
    RunInBackground=False,
    nickName="Part")

headstockbase = Point(Point(1130, -950, 710))
xy_2 = XYPlane(Origin=headstockbase)
mesh_4 = Mesh(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)
panel_4 = Panel("HeadStock")
part_4 = MechanicalPart(
    Alias=panel_4,
    Frame=xy_2,
    Object_Body=mesh_4,
    _0_0=panel_4,
    _1_0=xy_2,
    _2_0=mesh_4,
    Mode=0,
    RunInBackground=False,
    nickName="Part")

pt_4 = ConstructPoint(XCoordinate=0, YCoordinate=0, ZCoordinate="410")
xy_3 = XYPlane(Origin=pt_4)
panel_5 = Panel("IRB1600")
robot = Robot(
    Alias=panel_5,
    Location=xy_3,
    _0_0=panel_5,
    _1_0=xy_3,
    Mode=0,
    RunInBackground=False,
    catalogItem="Mechanism,8d00ec5d-26bc-46d5-bbd3-0ca891d5b62c",
    nickName="⧉ Robot")

robotbase = Plane(xy_3)
deplane = DeconstructPlane(Plane=robotbase)  # -> Origin, XAxis, YAxis, ZAxis
addition = Addition(A=pt, B=deplane.Origin)
pt_5 = Point(addition)
vec2pt = Vector2Pt(PointA=pt_2, PointB=pt_5, Unitize=False)  # -> Vector, Length
rev = Reverse(Vector=vec2pt.Vector)
move = Move(Geometry=robotbase, Motion=rev)  # -> Geometry, Transform

substructurebase = Point(Point(-1175.5, -950, 10))
xy_4 = XYPlane(Origin=substructurebase)
mesh_5 = Mesh([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])
panel_6 = Panel("SubStructure")
part_5 = MechanicalPart(
    Alias=panel_6,
    Frame=move.Geometry,
    Object_Body=mesh_5,
    _0_0=panel_6,
    _1_0=move,
    _2_0=mesh_5,
    Mode=0,
    RunInBackground=False,
    nickName="Part")

vec = VectorXYZ(XComponent=0, YComponent=0, ZComponent=Slider(100, range=0..100))  # -> Vector, Length
xy_5 = XYPlane(Origin=vec.Vector)

# ---- group: Tool
xy_6 = XYPlane(Origin=Point(0, 0, 0))
panel_7 = Panel("1.0")
mesh_6 = Mesh([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])
panel_8 = Panel("AW PSF 25")
tool = Tool(
    Alias=panel_8,
    Frame=xy_6,
    Object_Body=mesh_6,
    MassKg=panel_7,
    CenterOfMass=xy_5,
    ToolFrame=eulerframe,
    _0_0=panel_8,
    _1_0=xy_6,
    _2_0=mesh_6,
    _4_0=panel_7,
    _5_0=xy_5,
    _6_0=eulerframe,
    Mode=0,
    RunInBackground=False,
    nickName="Tool")

# ----
number_slider_2 = Slider(10, range=0..10)
rad = Radians(Degrees=Slider(180, range=-180..180))
rad_2 = Radians(Degrees=Slider(-180, range=-180..180))
angularspeed_rad_s = AngularSpeed(Slider(10, range=0..10), isNickNameImplied=True, locked=False, unit="rad_s")
panel_9 = Panel("Positioner-J1")
revolutejoint = OBSOLETERevoluteJoint(
    Alias=panel_9,
    From=part_3,
    To=part,
    Frame=pl,
    PositionRad=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,
    MinPositionRad=rad_2,
    MaxPositionRad=rad,
    MaxSpeedRadS=angularspeed_rad_s,
    Mapping=number_slider_2,
    _0_0=panel_9,
    _10_0=number_slider_2,
    _1_0=part_3,
    _2_0=part,
    _3_0=pl,
    _5_0=rad_2,
    _6_0=rad,
    _7_0=angularspeed_rad_s,
    Mode=0,
    RunInBackground=False,
    nickName="RevoluteJoint")

number_slider_3 = Slider(1, range=0..30)
number_slider_4 = Slider(0, range=0..100)
number_slider_5 = Slider(74.3, range=0..200)
panel_10 = Panel("WeldBlend")
speed = SpeedSettings(PositionMmS=number_slider_5, _1_0=number_slider_5, Mode=0, RunInBackground=False, nickName="Speed")
blend = BlendSettings(
    Alias=panel_10,
    PositionMm=number_slider_3,
    OrientationRad=number_slider_4,
    _0_0=panel_10,
    _1_0=number_slider_3,
    _2_0=number_slider_4,
    Mode=0,
    RunInBackground=False,
    nickName="Blend")
panel_11 = Panel("Welding")

bottomrightcorner = Point(Point(-961.37, -400, 1010))
xy_7 = XYPlane(Origin=bottomrightcorner)
orient = Orient(Geometry=robotbase, Source=robotbase, Target=xy_7)  # -> Geometry, Transform
panel_12 = Panel("SupportReference")
reference = CreateReference(
    Alias=panel_12,
    Frame=orient.Geometry,
    Parent=part_2,
    InWorld=True,
    _0_0=panel_12,
    _1_0=orient,
    _2_0=part_2,
    Mode=0,
    RunInBackground=False,
    nickName="Reference")

number_slider_6 = Slider(800, range=-2000..2000)
number_slider_7 = Slider(-500, range=-2000..2000)
number_slider_8 = Slider(4.5, range=0..300)
eulerframe_2 = EulerFrame(
    XMm=number_slider_6,
    YMm=number_slider_7,
    ZMm=number_slider_8,
    AxisA={halEnum=2, halEnumType="HAL.Spatial.Axis"},
    AxisB={halEnum=1, halEnumType="HAL.Spatial.Axis"},
    AxisC={halEnum=0, halEnumType="HAL.Spatial.Axis"},
    AngleA=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,
    AngleB=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,
    AngleC=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,
    _0_0=number_slider_6,
    _1_0=number_slider_7,
    _2_0=number_slider_8,
    Mode=0,
    RunInBackground=False,
    nickName="EulerFrame")
panel_13 = Panel("Plate")
reference_2 = CreateReference(
    Alias=panel_13,
    Frame=eulerframe_2,
    Parent=reference,
    InWorld=invert(True),
    _0_0=panel_13,
    _1_0=eulerframe_2,
    _2_0=reference,
    Mode=0,
    RunInBackground=False,
    nickName="Reference")

plate = Part(reference_2, isNickNameImplied=True)

number_slider_9 = Slider(1000, range=0..1000)
number_slider_10 = Slider(10, range=0..10)
number_slider_11 = Slider(1, range=0..100)
speed_2 = SpeedSettings(
    PositionMmS=number_slider_9,
    OrientationRadS=number_slider_9,
    _1_0=number_slider_9,
    _2_0=number_slider_9,
    Mode=0,
    RunInBackground=False,
    nickName="Speed")
blend_2 = BlendSettings(
    PositionMm=number_slider_10,
    Orientation=number_slider_11,
    _1_0=number_slider_10,
    _2_0=number_slider_11,
    Mode=0,
    RunInBackground=False,
    nickName="Blend")
panel_14 = Panel("Approach")

panel_15 = Panel("WeldBot")

attach = OBSOLETEAttach(
    Alias=panel_15,
    Parent=robot,
    Child=tool,
    IsEndEffector=True,
    Location=Plane(origin=(-1.234321012e+308, -1.234321012e+308, -1.234321012e+308), x=(0, 0, 0), y=(0, 0, 0)),
    InWorld=True,
    _0_0=panel_15,
    _1_0=robot,
    _2_0=tool,
    Mode=0,
    RunInBackground=False,
    nickName="Attach")
robot_2 = Mechanism(attach, isNickNameImplied=True)

panel_16 = Panel("Sub-TailStock")
connection = Connection(
    Alias=panel_16,
    From=part_5,
    To=part_3,
    Frame=xy,
    InWorld=True,
    IsEndPoint=False,
    _0_0=panel_16,
    _1_0=part_5,
    _2_0=part_3,
    _3_0=xy,
    Mode=0,
    RunInBackground=False,
    nickName="Connection")

panel_17 = Panel("Sub-HeadStock")
connection_2 = Connection(
    Alias=panel_17,
    From=part_5,
    To=part_4,
    Frame=xy_2,
    InWorld=True,
    IsEndPoint=False,
    _0_0=panel_17,
    _1_0=part_5,
    _2_0=part_4,
    _3_0=xy_2,
    Mode=0,
    RunInBackground=False,
    nickName="Connection")

panel_18 = Panel("Plate-Support")
connection_3 = Connection(
    Alias=panel_18,
    From=part,
    Frame=pl_2,
    InWorld=True,
    IsEndPoint=invert(False),
    _0_0=panel_18,
    _1_0=part,
    _3_0=pl_2,
    Mode=0,
    RunInBackground=False,
    nickName="Connection")

motionsettings = OBSOLETEMotionSettings(
    Alias=panel_14,
    Space={halEnum=1, halEnumType="HAL.Motion.Settings.MotionSpace"},
    Speed=speed_2,
    Blend=blend_2,
    _0_0=panel_14,
    _2_0=speed_2,
    _4_0=blend_2,
    Mode=0,
    RunInBackground=False,
    nickName="MotionSettings")
approachsettings = MotionSettings(motionsettings, isNickNameImplied=True)

merge = Merge(
    Data1=flatten(part_5),
    Data2=flatten(part_4),
    Data3=flatten(part_3),
    Data4=flatten(part),
    Data6=flatten(connection_2),
    Data7=flatten(connection),
    Data8=flatten(revolutejoint),
    Data9=flatten(connection_3))  # -> flatten(Result)
panel_19 = Panel("STN1")
assemble = OBSOLETEAssemble(Alias=panel_19, Object_Component=merge, _0_0=panel_19, _1_0=merge, Mode=0, RunInBackground=False, nickName="Assemble")

positioner = Mechanism(assemble, isNickNameImplied=True)
attach_2 = OBSOLETEAttachPartToMechanism(
    Mechanism=positioner,
    Part=part_2,
    InWorld=True,
    _0_0=positioner,
    _1_0=part_2,
    Mode=0,
    RunInBackground=False,
    nickName="Attach")  # -> Mechanism, Part

positioner_2 = Mechanism(attach_2.Mechanism, isNickNameImplied=True)
robot_3 = Mechanism(attach, isNickNameImplied=True)

# ---- group: MasterSolverConstraints
kinematics = KinematicSettings(Mechanism=positioner_2, _1_0=positioner_2, Mode=0, RunInBackground=False, nickName="Kinematics")

# ---- group: DefaultSolver
kinematics_2 = KinematicSettings(Mechanism=robot_3, _1_0=robot_3, Mode=0, RunInBackground=False, nickName="Kinematics")

# ----
kinematics_3 = KinematicSettings(
    Primary=kinematics,
    Object_Secondary=kinematics_2,
    _1_0=kinematics,
    _2_0=kinematics_2,
    Mode=0,
    RunInBackground=False,
    nickName="Kinematics")
motionsettings_2 = OBSOLETEMotionSettings(
    Alias=panel_11,
    Space={halEnum=0, halEnumType="HAL.Motion.Settings.MotionSpace"},
    Speed=speed,
    Blend=blend,
    Kinematics=kinematics_3,
    _0_0=panel_11,
    _2_0=speed,
    _4_0=blend,
    _5_0=kinematics_3,
    Mode=0,
    RunInBackground=False,
    nickName="MotionSettings")
weldingsettings = MotionSettings(motionsettings_2, isNickNameImplied=True)

merge_2 = Merge(
    Data1=Slider(-82, range=-180..180),
    Data2=Slider(-2, range=-180..180),
    Data3=Slider(26, range=-180..180),
    Data4=Slider(-50, range=-180..180),
    Data5=Slider(52, range=-180..180),
    Data6=Slider(70, range=-180..180))  # -> flatten(Result)
rad_3 = Radians(Degrees=merge_2)
target = Target(Mechanism=robot_2, Object_Position=rad_3, _1_0=robot_2, _2_0=rad_3, Mode=0, RunInBackground=False, nickName="Target")
approachsettings_2 = MotionSettings(approachsettings, isNickNameImplied=True)
move_2 = Move(
    Object_Target=target,
    Object_MotionSettings=approachsettings_2,
    _1_0=target,
    _2_0=approachsettings_2,
    Mode=0,
    RunInBackground=False,
    nickName="Move")

rad_4 = Radians(Degrees=Slider(0, range=-180..180))
positioner_3 = Mechanism(attach_2.Mechanism, isNickNameImplied=True)
target_2 = Target(
    Mechanism=positioner_3,
    Object_Position=rad_4,
    _1_0=positioner_3,
    _2_0=rad_4,
    Mode=0,
    RunInBackground=False,
    nickName="Target")
approachsettings_3 = MotionSettings(approachsettings, isNickNameImplied=True)
panel_20 = Panel("Init")
move_3 = Move(
    Alias=panel_20,
    Object_Target=target_2,
    Object_MotionSettings=approachsettings_3,
    _0_0=panel_20,
    _1_0=target_2,
    _2_0=approachsettings_3,
    Mode=0,
    RunInBackground=False,
    nickName="Move")

support = Part(part_2, isNickNameImplied=True)

xoffset = Slider(20, range=0..100)
zoffset = Slider(0, range=0..20)
yoffset = Slider(30, range=0..100)
length = Slider(100, range=0..1000)
pt_6 = ConstructPoint(XCoordinate=xoffset, YCoordinate=yoffset, ZCoordinate=zoffset)
plate_2 = Part(plate, isNickNameImplied=True)
number_slider_12 = Slider(30, range=-180..180)
number_slider_13 = Slider(90, range=0..100)

X = UnitX(Factor=1)
panel_21 = Panel("WeldRows")
sync = SyncSettings(Alias=panel_21, _0_0=panel_21, Mode=0, RunInBackground=False, nickName="Sync")
initialise = Procedure(move_2, isNickNameImplied=True)

line = LineSDL(Start=pt_6, Direction=X, Length=length)
target_3 = Target(
    Alias="Curve",
    Curve=line,
    Discretization={halEnum=1, halEnumType="HAL.McNeel.RhinoCommon5.Spatial.CurveDiscretization"},
    ToleranceMm=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,
    Reference=plate_2,
    InWorld=invert(True),
    _1_0=line,
    _4_0=plate_2,
    Mode=0,
    RunInBackground=False,
    nickName="Target")  # -> simplify(Object_Target), Trace
transform = Transform(
    Target=target_3.Object_Target,
    XMm=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,
    YMm=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,
    ZMm=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,
    RX=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,
    RY=number_slider_12,
    RZ=number_slider_13,
    _0_0=target_3,
    _6_0=number_slider_12,
    _7_0=number_slider_13,
    Mode=0,
    RunInBackground=False,
    nickName="Transform")

startweldingsettings = MotionSettings(weldingsettings, isNickNameImplied=True)
target_4 = Target(simplify(transform), isNickNameImplied=True)
weldrows = SyncSettings(sync, isNickNameImplied=True)
panel_22 = Panel("Weld")
move_4 = Move(
    Alias=panel_22,
    Object_Target=target_4,
    Object_MotionSettings=startweldingsettings,
    Object_Sync=weldrows,
    _0_0=panel_22,
    _1_0=target_4,
    _2_0=startweldingsettings,
    _3_0=weldrows,
    Mode=0,
    RunInBackground=False,
    nickName="Move")  # -> simplify(flatten(Action))

weldrows_2 = Procedure(move_4, isNickNameImplied=True)

Z_3 = UnitZ(Factor=expr("-x", 1))
aligned = OBSOLETEAlignedToVector(
    Direction=Z_3,
    Axis={halEnum=2, halEnumType="HAL.Spatial.Axis"},
    Flip=False,
    Project=False,
    Average=True,
    _0_0=Z_3,
    Mode=0,
    RunInBackground=False,
    nickName="Aligned")
startweldingsettings_2 = MotionSettings(weldingsettings, isNickNameImplied=True)
weldrows_3 = Procedure(weldrows_2, isNickNameImplied=True)
panel_23 = Panel("WeldRows")
synchronized = Synchronized(
    Alias=panel_23,
    Procedure=weldrows_3,
    Target=aligned,
    MotionSettings=startweldingsettings_2,
    _0_0=panel_23,
    _1_0=weldrows_3,
    _2_0=aligned,
    _3_0=startweldingsettings_2,
    Mode=0,
    RunInBackground=False,
    nickName="Synchronized")

initialise_2 = Procedure(initialise, isNickNameImplied=True)
weldrows_4 = Procedure(weldrows_2, isNickNameImplied=True)
merge_3 = Merge(Data1=flatten(initialise_2), Data2=flatten(weldrows_4), Data3=flatten(initialise_2))
panel_24 = Panel("WeldPrimitives")
combine = CombineActions(
    Alias=panel_24,
    Object_Combined=merge_3,
    Compact=invert(True),
    _0_0=panel_24,
    _1_0=merge_3,
    Mode=0,
    RunInBackground=False,
    nickName="Combine")
manipulatorprocedure = Procedure(combine, isNickNameImplied=True)

merge_4 = Merge(Data1=flatten(move_3), Data2=flatten(synchronized), Data3=flatten(move_3))
combine_2 = CombineActions(Object_Combined=merge_4, Compact=True, _1_0=merge_4, Mode=0, RunInBackground=False, nickName="Combine")
positionerprocedure = Procedure(combine_2, isNickNameImplied=True)

manipulatorprocedure_2 = Procedure(manipulatorprocedure, isNickNameImplied=True)
positionerprocedure_2 = Procedure(positionerprocedure, isNickNameImplied=True)
manipulator = Mechanism(attach, isNickNameImplied=True)
positioner_4 = Mechanism(attach_2.Mechanism, isNickNameImplied=True)
merge_5 = Merge(Data1=flatten(manipulatorprocedure_2), Data2=flatten(positionerprocedure_2))
merge_6 = Merge(Data1=flatten(manipulator), Data2=flatten(positioner_4))
controller = Controller(
    Alias="Custom controller",
    Object_Mechanism=merge_6,
    Object_Procedure=merge_5,
    _2_0=merge_6,
    _3_0=merge_5,
    Mode=0,
    RunInBackground=False,
    catalogItem="Controller,e12b94cc-ab89-4d92-9f10-47e223790ee6",
    nickName="⧉ Controller")
solve = BooleanToggle(True)
solve_2 = OBSOLETEProcedureSolver(Controller=controller, Solve=solve, Mode=0, RunInBackground=True)  # -> Solution, Object_Solved, Notification
execution_control = ExecutionControl(Loop=True, TimeRatio=1)
execute = OBSOLETEExecute(
    ExecutionControl=execution_control,
    Solution=solve_2.Solution,
    Object_Environment=support,
    displayEnvironment=True,
    displayMechanisms=True,
    displayTrace=True)
