# Grasshopper definition 3.7 - Change a Tool at Runtime [Mar-29 '26, 2031].gh (Grasshopper 1.0.8)
# plug-ins: HAL for Grasshopper

sessionsettings = SessionSettings()  # -> Data, DefaultSettings

# ---- group: Targets / Floating Tool Locations
merge = Merge(Data1=Slider(100, range=-200..200), Data2=Slider(10, range=-200..200), Data3=Slider(-100, range=-200..200))
number_slider = Slider(550, range=0..1000)
number_slider_2 = Slider(170, range=0..1000)
number_slider_3 = Slider(180, range=-180..180)
eulerframe = EulerFrame(
    XMm=number_slider,
    YMm=merge,
    ZMm=number_slider_2,
    AxisA={halEnum=2, halEnumType="HAL.Spatial.Axis"},
    AxisB={halEnum=1, halEnumType="HAL.Spatial.Axis"},
    AxisC={halEnum=0, halEnumType="HAL.Spatial.Axis"},
    AngleARad=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,
    AngleB=number_slider_3,
    AngleCRad=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,
    _0_0=number_slider,
    _1_0=merge,
    _2_0=number_slider_2,
    _7_0=number_slider_3,
    Mode=0,
    RunInBackground=False,
    nickName="EulerFrame")
item = ListItem(List=eulerframe, Index=0, Wrap=True)  # -> Item, Item1, Item2
conelocation = Plane(item.Item)
interfacelocation = Plane(item.Item1)
multitoollocation = Plane(item.Item2)

# ---- group: Create Multi-Tool / Geometry and Frames
multitool = MultiTool()  # -> baseframe, endpoints, body

# ---- group: Create Tool Changer / Geometry and Frames
toolchanger = ToolChanger()  # -> baseframe, endpoint, body_2

# ---- group: Shared Motion Settings
number_slider_4 = Slider(100, range=0..100)
number_slider_5 = Slider(0, range=0..100)
speed = SpeedSettings(PositionMmS=number_slider_4, _1_0=number_slider_4, Mode=0, RunInBackground=False, nickName="Speed")
blend = BlendSettings(
    PositionMm=number_slider_5,
    OrientationRad=number_slider_5,
    _1_0=number_slider_5,
    _2_0=number_slider_5,
    Mode=0,
    RunInBackground=False,
    nickName="Blend")
panel = Panel("CartesianSettings")
motionsettings = OBSOLETEMotionSettings(
    Alias=panel,
    Space={halEnum=0, halEnumType="HAL.Motion.Settings.MotionSpace"},
    Speed=speed,
    Blend=blend,
    _0_0=panel,
    _2_0=speed,
    _4_0=blend,
    Mode=0,
    RunInBackground=False,
    nickName="MotionSettings")
cartesiansettings = MotionSettings(motionsettings, isNickNameImplied=True)

# ---- group: Create Tool Changer
panel_2 = Panel("ToolInterface")
tool = Tool(
    Alias=panel_2,
    Frame=toolchanger.baseframe,
    Object_Body=toolchanger.body_2,
    ToolFrame=toolchanger.endpoint,
    _0_0=panel_2,
    _1_0=toolchanger,
    _2_0=toolchanger,
    _6_0=toolchanger,
    Mode=0,
    RunInBackground=False,
    nickName="Tool")

# ----
interface = Mechanism(tool, isNickNameImplied=True)

# ---- group: Create Tool Changer / Relocate Tool
interfacelocation_2 = Plane(interfacelocation)
relocate = RelocateMechanism(
    Mechanism=interface,
    Location=interfacelocation_2,
    _0_0=interface,
    _1_0=interfacelocation_2,
    Mode=0,
    RunInBackground=False,
    nickName="Relocate")
toolinterface = Mechanism(relocate, isNickNameImplied=True)

# ---- group: Targets / Convert to Targets
multitoollocation_2 = Plane(multitoollocation)
interfacelocation_3 = Plane(interfacelocation)
conelocation_2 = Plane(conelocation)
interfacepicktarget = Target(interfacelocation_3, isNickNameImplied=True)
multitoolpicktarget = Target(multitoollocation_2, isNickNameImplied=True)
conepicktarget = Target(conelocation_2, isNickNameImplied=True)

# ---- group: Initial Robot Setup
number_slider_6 = Slider(200, range=0..1000)
cone = Cone(Base=PlaneXY(0, 0, 0), Radius=Slider(20, range=0..100), Length=number_slider_6)  # -> Cone, Tip
xy = XYPlane(Origin=cone.Tip)
panel_3 = Panel("Cone")

# ---- group: Targets / Tool Path Segments
number_slider_7 = Slider(-20, range=-100..100)
merge_2 = Merge(Data1=flatten(conepicktarget), Data2=flatten(interfacepicktarget), Data3=flatten(multitoolpicktarget))
panel_4 = Panel(number_slider_6)
transform = Transform(
    Target=merge_2,
    XMm=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,
    YMm=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,
    ZMm=number_slider_7,
    RXRad=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,
    RYRad=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,
    RZRad=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,
    _0_0=merge_2,
    _4_0=number_slider_7,
    Mode=0,
    RunInBackground=False,
    nickName="Transform")
transform_2 = Transform(
    Target=conepicktarget,
    XMm=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,
    YMm=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,
    ZMm=panel_4,
    RXRad=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,
    RYRad=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,
    RZRad=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,
    _0_0=conepicktarget,
    _4_0=panel_4,
    Mode=0,
    RunInBackground=False,
    nickName="Transform")
item_2 = ListItem(List=transform, Index=0, Wrap=True)  # -> Item, Item1, Item2
conedroptarget = Target(transform_2, isNickNameImplied=True)
interfacepicktarget_2 = Target(interfacepicktarget, isNickNameImplied=True)
multitoolpicktarget_2 = Target(multitoolpicktarget, isNickNameImplied=True)
merge_3 = Merge(Data1=flatten(item_2.Item), Data2=flatten(item_2.Item1), Data3=flatten(interfacepicktarget_2))
merge_4 = Merge(Data1=flatten(item_2.Item1), Data2=flatten(item_2.Item2), Data3=flatten(multitoolpicktarget_2))
merge_5 = Merge(Data1=flatten(item_2.Item), Data2=flatten(item_2.Item2))
usemultitooltargets = Target(merge_5, isNickNameImplied=True)
gotomultitool = Target(merge_4, isNickNameImplied=True)
gotointerface = Target(merge_3, isNickNameImplied=True)

# ---- group: Program Robot
conedroptarget_2 = Target(conedroptarget, isNickNameImplied=True)
cartesiansettings_2 = MotionSettings(cartesiansettings, isNickNameImplied=True)
panel_5 = Panel("GoToConeChange")
move = Move(
    Alias=panel_5,
    Object_Target=conedroptarget_2,
    Object_MotionSettings=cartesiansettings_2,
    _0_0=panel_5,
    _1_0=conedroptarget_2,
    _2_0=cartesiansettings_2,
    Mode=0,
    RunInBackground=False,
    nickName="Move")

# ---- group: Program Robot / Jump to Next Position
gotomultitool_2 = Target(gotomultitool, isNickNameImplied=True)
cartesiansettings_3 = MotionSettings(cartesiansettings, isNickNameImplied=True)
panel_6 = Panel("GoToMulti")
move_2 = Move(
    Alias=panel_6,
    Object_Target=gotomultitool_2,
    Object_MotionSettings=cartesiansettings_3,
    _0_0=panel_6,
    _1_0=gotomultitool_2,
    _2_0=cartesiansettings_3,
    Mode=0,
    RunInBackground=False,
    nickName="Move")

# ---- group: Program Robot / Move using Active End Point
usemultitooltargets_2 = Target(usemultitooltargets, isNickNameImplied=True)
cartesiansettings_4 = MotionSettings(cartesiansettings, isNickNameImplied=True)
panel_7 = Panel("UseCombiTool1")
move_3 = Move(
    Alias=panel_7,
    Object_Target=usemultitooltargets_2,
    Object_MotionSettings=cartesiansettings_4,
    _0_0=panel_7,
    _1_0=usemultitooltargets_2,
    _2_0=cartesiansettings_4,
    Mode=0,
    RunInBackground=False,
    nickName="Move")

usemultitooltargets_3 = Target(usemultitooltargets, isNickNameImplied=True)
cartesiansettings_5 = MotionSettings(cartesiansettings, isNickNameImplied=True)
panel_8 = Panel("UseMultiTool2")
move_4 = Move(
    Alias=panel_8,
    Object_Target=usemultitooltargets_3,
    Object_MotionSettings=cartesiansettings_5,
    _0_0=panel_8,
    _1_0=usemultitooltargets_3,
    _2_0=cartesiansettings_5,
    Mode=0,
    RunInBackground=False,
    nickName="Move")

# ---- group: Program Robot / Jump to Next Position
cartesiansettings_6 = MotionSettings(cartesiansettings, isNickNameImplied=True)
gotointerface_2 = Target(gotointerface, isNickNameImplied=True)
panel_9 = Panel("GoToInterface")
move_5 = Move(
    Alias=panel_9,
    Object_Target=gotointerface_2,
    Object_MotionSettings=cartesiansettings_6,
    _0_0=panel_9,
    _1_0=gotointerface_2,
    _2_0=cartesiansettings_6,
    Mode=0,
    RunInBackground=False,
    nickName="Move")

# ---- group: Create Multi-Tool
part = MechanicalPart(
    Alias="Custom Part",
    Frame=multitool.baseframe,
    Object_Body=multitool.body,
    _1_0=multitool,
    _2_0=multitool,
    Mode=0,
    RunInBackground=False,
    nickName="Part")
panel_10 = Panel("""MultiTCP1
MultiTCP2""")
connection = Connection(
    Alias=panel_10,
    From=part,
    Frame=multitool.endpoints,
    InWorld=True,
    IsEndPoint=invert(False),
    _0_0=panel_10,
    _1_0=part,
    _3_0=multitool,
    Mode=0,
    RunInBackground=False,
    nickName="Connection")
item_3 = ListItem(List=connection, Index=0, Wrap=True)  # -> Item, Item1
panel_11 = Panel("MultiTool")
tcp1 = Part(item_3.Item, isNickNameImplied=True)
tcp2 = Part(item_3.Item1, isNickNameImplied=True)

# ----
multitoolparts = Part(part, isNickNameImplied=True)

# ---- group: Create Multi-Tool (continued)
merge_6 = Merge(Data1=flatten(multitoolparts), Data2=flatten(connection))
assemble = OBSOLETEAssemble(
    Alias=panel_11,
    Object_Component=merge_6,
    _0_0=panel_11,
    _1_0=merge_6,
    Mode=0,
    RunInBackground=False,
    nickName="Assemble")

# ---- group: Create Multi-Tool / Relocate Tool
multitoollocation_3 = Plane(multitoollocation)
relocate_2 = RelocateMechanism(
    Mechanism=assemble,
    Location=multitoollocation_3,
    _0_0=assemble,
    _1_0=multitoollocation_3,
    Mode=0,
    RunInBackground=False,
    nickName="Relocate")
multitool_2 = Mechanism(relocate_2, isNickNameImplied=True)

# ---- group: Initial Robot Setup
mesh = MeshBrep(
    Brep=cone.Cone,
    Settings={GridMaxCount=0, GridMinCount=16, JaggedSeams=False, MaxEdgeLength=0, MinEdgeLength=0.0001, MinTolerance=0, Refine=True, RefineAngle=0, RelativeTolerance=0.65, SimplePlanes=True, Tolerance=0})
xy_2 = XYPlane(Origin=Point(0, 0, 0))
robot = Robot(
    Alias="Robot",
    Mode=0,
    RunInBackground=False,
    catalogItem="Mechanism,eef11b27-6f7d-47af-9d81-696fe3dab7b5",
    nickName="⧉ Robot")

tool_2 = Tool(
    Alias=panel_3,
    Frame=xy_2,
    Object_Body=mesh,
    ToolFrame=xy,
    _0_0=panel_3,
    _1_0=xy_2,
    _2_0=mesh,
    _6_0=xy,
    Mode=0,
    RunInBackground=False,
    nickName="Tool")

conetool = Mechanism(tool_2, isNickNameImplied=True)
attach = OBSOLETEAttach(
    Alias="Composite Mechanism",
    Parent=robot,
    Child=conetool,
    IsEndEffector=True,
    Location=Plane(origin=(-1.234321012e+308, -1.234321012e+308, -1.234321012e+308), x=(0, 0, 0), y=(0, 0, 0)),
    InWorld=True,
    _1_0=robot,
    _2_0=conetool,
    Mode=0,
    RunInBackground=False,
    nickName="Attach")
robottoolcombo = Mechanism(attach, isNickNameImplied=True)

# ---- group: Program Robot / Initial Joint Move
robottoolcombo_2 = Mechanism(robottoolcombo, isNickNameImplied=True)
merge_7 = Merge(
    Data1=Slider(10, range=-180..180),
    Data2=Slider(40, range=-180..180),
    Data3=Slider(15, range=-180..180),
    Data4=Slider(0, range=-180..180),
    Data5=Slider(36, range=-180..180),
    Data6=Slider(0, range=-180..180))  # -> flatten(Result)
rad = Radians(Degrees=merge_7)
target = Target(
    Mechanism=robottoolcombo_2,
    Object_Position=rad,
    _1_0=robottoolcombo_2,
    _2_0=rad,
    Mode=0,
    RunInBackground=False,
    nickName="Target")
motionsettings_2 = OBSOLETEMotionSettings(
    Space={halEnum=1, halEnumType="HAL.Motion.Settings.MotionSpace"},
    Mode=0,
    RunInBackground=False,
    nickName="MotionSettings")
move_6 = Move(
    Object_Target=target,
    Object_MotionSettings=motionsettings_2,
    _1_0=target,
    _2_0=motionsettings_2,
    Mode=0,
    RunInBackground=False,
    nickName="Move")

# ---- group: Program Robot / Remove Tool
robottoolcombo_3 = Mechanism(robottoolcombo, isNickNameImplied=True)
cone_2 = Mechanism(conetool, isNickNameImplied=True)
panel_12 = Panel("RemoveCone")
detachtool = DetachTool(
    Alias=panel_12,
    Mechanism=robottoolcombo_3,
    Tool=cone_2,
    _0_0=panel_12,
    _1_0=robottoolcombo_3,
    _2_0=cone_2,
    Mode=0,
    RunInBackground=False,
    nickName="DetachTool")

# ---- group: Program Robot / Attach Tool
toolinterface_2 = Mechanism(toolinterface, isNickNameImplied=True)
robottoolcombo_4 = Mechanism(robottoolcombo, isNickNameImplied=True)
panel_13 = Panel("AttachInterface")
attachtool = AttachTool(
    Alias=panel_13,
    Mechanism=robottoolcombo_4,
    Tool=toolinterface_2,
    _0_0=panel_13,
    _1_0=robottoolcombo_4,
    _2_0=toolinterface_2,
    Mode=0,
    RunInBackground=False,
    nickName="AttachTool")

# ---- group: Program Robot / Attach Compound Tool
multitool_3 = Mechanism(multitool_2, isNickNameImplied=True)
robottoolcombo_5 = Mechanism(robottoolcombo, isNickNameImplied=True)
panel_14 = Panel("AttachMulti")
attachtool_2 = AttachTool(
    Alias=panel_14,
    Mechanism=robottoolcombo_5,
    Tool=multitool_3,
    _0_0=panel_14,
    _1_0=robottoolcombo_5,
    _2_0=multitool_3,
    Mode=0,
    RunInBackground=False,
    nickName="AttachTool")

# ---- group: Program Robot / Set Active End Point
robottoolcombo_6 = Mechanism(robottoolcombo, isNickNameImplied=True)
tcp1_2 = Part(tcp1, isNickNameImplied=True)
panel_15 = Panel("SetMultiTool1")
changetool = ChangeTool(
    Alias=panel_15,
    Mechanism=robottoolcombo_6,
    EndPoint=tcp1_2,
    _0_0=panel_15,
    _1_0=robottoolcombo_6,
    _2_0=tcp1_2,
    Mode=0,
    RunInBackground=False,
    nickName="ChangeTool")

# ---- group: Program Robot / Change Active End Point
robottoolcombo_7 = Mechanism(robottoolcombo, isNickNameImplied=True)
tcp2_2 = Part(tcp2, isNickNameImplied=True)
panel_16 = Panel("SetMultiTool2")
changetool_2 = ChangeTool(
    Alias=panel_16,
    Mechanism=robottoolcombo_7,
    EndPoint=tcp2_2,
    _0_0=panel_16,
    _1_0=robottoolcombo_7,
    _2_0=tcp2_2,
    Mode=0,
    RunInBackground=False,
    nickName="ChangeTool")

# ---- group: Program Robot
change_active_end_point = Procedure(changetool_2, isNickNameImplied=True)
jump_to_next_position = Procedure(move_5, isNickNameImplied=True)
jump_to_next_position_2 = Procedure(move_2, isNickNameImplied=True)
go_to_cone_drop_off = Procedure(move, isNickNameImplied=True)
use_active_end_point = Procedure(move_3, isNickNameImplied=True)
use_active_end_point_2 = Procedure(move_4, isNickNameImplied=True)
set_active_end_point = Procedure(changetool, isNickNameImplied=True)
attach_tool_on_tool = Procedure(attachtool_2, isNickNameImplied=True)
attach_new_tool = Procedure(attachtool, isNickNameImplied=True)
initial_position = Procedure(move_6, isNickNameImplied=True)
remove_cone = Procedure(detachtool, isNickNameImplied=True)

# ---- group: Merge, Combine, Solve and Execute
initial_position_2 = Procedure(initial_position, isNickNameImplied=True)
go_to_cone_drop_off_2 = Procedure(go_to_cone_drop_off, isNickNameImplied=True)
set_active_end_point_2 = Procedure(set_active_end_point, isNickNameImplied=True)
remove_cone_2 = Procedure(remove_cone, isNickNameImplied=True)
jump_to_next_position_3 = Procedure(jump_to_next_position, isNickNameImplied=True)
attach_new_tool_2 = Procedure(attach_new_tool, isNickNameImplied=True)
jump_to_next_position_4 = Procedure(jump_to_next_position_2, isNickNameImplied=True)
attach_tool_on_tool_2 = Procedure(attach_tool_on_tool, isNickNameImplied=True)
use_active_end_point_3 = Procedure(use_active_end_point, isNickNameImplied=True)
change_active_end_point_2 = Procedure(change_active_end_point, isNickNameImplied=True)
use_active_end_point_4 = Procedure(use_active_end_point_2, isNickNameImplied=True)
merge_8 = Merge(
    Data1=flatten(initial_position_2),
    Data2=flatten(go_to_cone_drop_off_2),
    Data3=flatten(remove_cone_2),
    Data4=flatten(jump_to_next_position_3),
    Data5=flatten(attach_new_tool_2),
    Data6=flatten(jump_to_next_position_4),
    Data7=flatten(attach_tool_on_tool_2),
    Data8=flatten(set_active_end_point_2),
    Data9=flatten(use_active_end_point_3),
    Data10=flatten(change_active_end_point_2),
    Data11=flatten(use_active_end_point_4))
combine = CombineActions(Object_Combined=merge_8, Compact=True, _1_0=merge_8, Mode=0, RunInBackground=False, nickName="Combine")
robottoolcombo_8 = Mechanism(robottoolcombo, isNickNameImplied=True)
panel_17 = Panel("Controller")
controller = Controller(
    Alias=panel_17,
    Object_Mechanism=robottoolcombo_8,
    Object_Procedure=combine,
    _0_0=panel_17,
    _2_0=robottoolcombo_8,
    _3_0=combine,
    Mode=0,
    RunInBackground=False,
    catalogItem="Controller,3169879c-d516-4db0-9e63-03018ff58094",
    nickName="⧉ Controller")
solve = OBSOLETEProcedureSolver(Controller=controller, Solve=Toggle(True), Mode=0, RunInBackground=True)  # -> Solution, Object_Solved, Notification

# ---- group: Get Parts to Visualise
interface_2 = Mechanism(interface, isNickNameImplied=True)
cone_3 = Mechanism(conetool, isNickNameImplied=True)
disassemble = OBSOLETEDisassemble(Mechanism=[cone_3, interface_2], _0_0=cone_3, _0_1=interface_2, Mode=0, RunInBackground=False, nickName="Disassemble")  # -> Base, Object_Part, Object_Joint, Object_Connection, ActiveEndPoint, EndEffector, Object_SubMechanism, Object_Persistence
coneparts = Part(disassemble.Object_Part, isNickNameImplied=True)
multitoolparts_2 = Part(multitoolparts, isNickNameImplied=True)
merge_9 = Merge(Data1=flatten(coneparts), Data2=flatten(multitoolparts_2))

# ---- group: Merge, Combine, Solve and Execute
execution_control = ExecutionControl(Loop=False, TimeRatio=1)
execute = OBSOLETEExecute(
    ExecutionControl=execution_control,
    Solution=solve.Solution,
    Object_Environment=merge_9,
    displayEnvironment=True,
    displayMechanisms=True,
    displayTrace=True)

# ==== cluster MultiTool
number_slider = Slider(30, range=0..100)
xy = XYPlane(Origin=Point(0, 0, 0))
Z = UnitZ(Factor=Slider(100, range=0..100))
neg = Negative(Value=number_slider)
move = Move(Geometry=xy, Motion=Z)  # -> Geometry, Transform
cir = Circle(Plane=xy, Radius=Slider(20, range=0..100))
merge = Merge(Data1=number_slider, Data2=neg)
X = UnitX(Factor=merge)
move_2 = Move(Geometry=move.Geometry, Motion=X)  # -> Geometry, Transform
vec2pt = Vector2Pt(PointA=xy, PointB=move_2.Geometry, Unitize=False)  # -> Vector, Length
devec = DeconstructVector(Vector=vec2pt.Vector)  # -> XComponent, YComponent, ZComponent
pl = PlaneNormal(Origin=move_2.Geometry, ZAxis=vec2pt.Vector)
extr = ExtrudePoint(Base=cir, Point=move_2.Geometry)
vec = VectorXYZ(XComponent=devec.XComponent, YComponent=0, ZComponent=0)  # -> Vector, Length
align = AlignPlane(Plane=pl, Direction=vec.Vector)  # -> EndPoints, Angle
baseframe = ClusterOutput(xy)
endpoints = ClusterOutput(align.EndPoints)
body = ClusterOutput(extr)

# ==== cluster ToolChanger
number_slider = Slider(30, range=0..100)
xy = XYPlane(Origin=Point(0, 0, 0))
polygon = Polygon(Plane=xy, Radius=number_slider, Segments=8, FilletRadius=0)  # -> Polygon, Length
Z = UnitZ(Factor=number_slider)
extr = Extrude(Base=polygon.Polygon, Direction=Z)
cap = CapHoles(Brep=extr)
body = Mesh(cap)
body_2 = ClusterOutput(body)
move = Move(Geometry=xy, Motion=Z)  # -> Geometry, Transform
baseframe = ClusterOutput(xy)
endpoint = ClusterOutput(move.Geometry)
